# Grasshopper definition ex4-compas-vectors.ghx (Grasshopper 1.0.8)
# plug-ins: RhinoCodePluginGH

# ----
# Vector
panel = Panel("0")
vector = Python3Script(x="2", y=panel, z="0")  # -> u; inputs x: Int32, y: Int32, z: Int32
# ---------- vector: Python ----------
from compas.geometry import Vector

u = Vector(x, y, z)

print(u.direction)
print(u.magnitude)
# ---------- end vector ----------
vector_2 = Python3Script(x="1", y="1", z="0")  # -> v; inputs x: Int32, y: Int32, z: Int32
# ---------- vector_2: Python ----------
from compas.geometry import Vector

v = Vector(x, y, z)
# ---------- end vector_2 ----------
cross_product = Python3Script(u=vector, v=vector_2)  # -> cross, ortho
# ---------- cross_product: Python ----------
cross = u.cross(v)

print("Cross vector: {}".format(cross))

cross_inverse = v.cross(u)

print("Inverse cross vector: {}".format(cross_inverse))

print(cross == cross_inverse.inverted())

ortho = u.cross(cross)
# ---------- end cross_product ----------
draw = Python3Script(u=vector, v=vector_2, cross=cross_product.cross, ortho=cross_product.ortho)  # -> u, v, cross, ortho
# ---------- draw: Python ----------
from compas_rhino.conversions import vector_to_rhino

if u:
    u = vector_to_rhino(u)
if v:
    v = vector_to_rhino(v)
if cross:
    cross = vector_to_rhino(cross)
if ortho:
    ortho = vector_to_rhino(ortho)
# ---------- end draw ----------
vdisex = VectorDisplayEx(Point=Point(0, 0, 0), Vector=draw.u, Colour=ColourSwatch(SwatchColor=RGB(255, 0, 255)), Width=4)
vdisex_2 = VectorDisplayEx(Point=Point(0, 0, 0), Vector=draw.v, Colour=ColourSwatch(SwatchColor=RGB(113, 74, 255)), Width=4)
vdisex_3 = VectorDisplayEx(Point=Point(0, 0, 0), Vector=draw.cross, Colour=ColourSwatch(SwatchColor=RGB(55, 255, 128)), Width=4)
vdisex_4 = VectorDisplayEx(Point=Point(0, 0, 0), Vector=draw.ortho, Colour=ColourSwatch(SwatchColor=RGB(255, 203, 103)), Width=4)

# ----
# Point
panel_2 = Panel("0")
point = Python3Script(x="3", y="3", z=panel_2)  # -> point; inputs x: Double, y: Double, z: Double
# ---------- point: Python ----------
from compas.geometry import Point

point = Point(x, y, z)
print(point)
# ---------- end point ----------
draw_2 = Python3Script(point=point)  # -> point
# ---------- draw_2: Python ----------
from compas_rhino.conversions import point_to_rhino

if point:
    point = point_to_rhino(point)
    print(point)
# ---------- end draw_2 ----------
preview = CustomPreview(Geometry=draw_2, Material=ColourSwatch(SwatchColor=RGB(128, 162, 255)))

# ----
# Frame
pt = Point(Point(-2, 3, 0))
frame = Python3Script(point=pt, xaxis=vector, yaxis=cross_product.cross)  # -> frame; inputs point: Point3d
# ---------- frame: Python ----------
from compas.geometry import Frame, Point, Vector
from compas_rhino.conversions import point_to_compas

point = point_to_compas(point)
frame = Frame(point, xaxis, yaxis)
print(frame)
# ---------- end frame ----------
draw_3 = Python3Script(frame=frame)  # -> plane
# ---------- draw_3: Python ----------
from compas_rhino.conversions import frame_to_rhino_plane

if frame:
    plane = frame_to_rhino_plane(frame)
# ---------- end draw_3 ----------
preview_2 = CustomPreview(Geometry=draw_3, Material=ColourSwatch(SwatchColor=RGB(255, 0, 85)))

# ----
# Plane
plane = Python3Script(point=point, normal=cross_product.cross)  # -> plane
# ---------- plane: Python ----------
from compas.geometry import Plane

plane = Plane(point, normal)
print(plane)
# ---------- end plane ----------
draw_4 = Python3Script(plane=plane)  # -> plane
# ---------- draw_4: Python ----------
from compas_rhino.conversions import plane_to_rhino

if plane:
    plane = plane_to_rhino(plane)
# ---------- end draw_4 ----------
preview_3 = CustomPreview(Geometry=draw_4, Material=ColourSwatch(SwatchColor=RGB(0, 0, 255)))
