# Grasshopper definition ex02-happy-animal.gh (Grasshopper 1.0.8)
# plug-ins: RhinoCodePluginGH

show = BooleanToggle(True)
show_2 = BooleanToggle(True)
bored_animal = Python3Script(show=show_2)  # -> out, curves
# ---------- bored_animal: Python ----------
from compas.geometry import Point, Vector, Frame, Line, Circle
from compas.colors import Color
from random import random
from compas_rhino.conversions import circle_to_rhino_curve, line_to_rhino_curve

w=h=15

face = Circle(radius=w/2, frame=Frame(Point(0, 0, 0), Vector(1, 0, 0), Vector(0, 1, 0)))
eye_left = Line(Point(w/8,0,0), Point(w/3,0,0))
eye_right = Line(Point(-w/8,0,0), Point(-w/3,0,0))
mouth = Line(Point(-w/6,-h/6,0), Point(w/6,-h/6,0))

if show:
    curves = [circle_to_rhino_curve(face), line_to_rhino_curve(eye_left), line_to_rhino_curve(eye_right), line_to_rhino_curve(mouth)]
# ---------- end bored_animal ----------
_3d_animal = Python3Script(show=show)  # -> out, breps
# ---------- _3d_animal: Python ----------
from compas.geometry import Point, Vector, Frame, Line, Circle, Sphere, Cone, Torus
from compas.colors import Color
from random import random
from compas_rhino.conversions import circle_to_rhino_curve, sphere_to_rhino, torus_to_rhino_brep, cone_to_rhino_brep

w=h=15

face = Circle(radius=w/2, frame=Frame(Point(0, 0, 0), Vector(1, 0, 0), Vector(0, 1, 0)))
eye_left = Sphere(radius=1.5, point=Point(w/4,w/8,0))
eye_right = Sphere(radius=1.5, point=Point(-w/4,w/8,0))
nose = Cone(radius=0.5, height=2.0)
mouth = Torus(frame=Frame(Point(0,-w/4,0)), radius_axis=0.6, radius_pipe=0.3)

if show:
    breps = [circle_to_rhino_curve(face), sphere_to_rhino(eye_left), sphere_to_rhino(eye_right), cone_to_rhino_brep(nose), torus_to_rhino_brep(mouth)]
# ---------- end _3d_animal ----------
preview = CustomPreview(Geometry=bored_animal.curves, Material=ColourSwatch(SwatchColor=RGB(50, 201, 201)))
