# Grasshopper definition ex1-all-basic-geometries.ghx (Grasshopper 1.0.8)
# plug-ins: RhinoCodePluginGH

# ----
# Basic geometries
number = Slider(31, range=10..100)
point = Python3Script(x="-1", y="3", z="2")  # -> out, point, point_rg; inputs x: Double, y: Double, z: Double
# ---------- point: Python ----------
from compas.geometry import Point
from compas_rhino.conversions import point_to_rhino

point = Point(x, y, z)
print(point)

point_rg = point_to_rhino(point)
print(point_rg)
# ---------- end point ----------
vector = Python3Script()  # -> out, cross, cross_rg
# ---------- vector: Python ----------
from compas.geometry import Vector
from compas_rhino.conversions import vector_to_rhino

u = Vector(2, 0, 0)
v = Vector(0, 1, 0)

dot = u.dot(v)
cross = u.cross(v)

print(u, v)
print(u.direction)
print(v.magnitude)
print("Dot vector: {}".format(dot))
print("Cross vector: {}".format(cross))

cross_rg = vector_to_rhino(cross)
# ---------- end vector ----------
pt = Point(point.point_rg)
vec = Vector(vector.cross_rg)
plane = Python3Script(point=point.point, normal=vector.cross)  # -> out, plane_rg
# ---------- plane: Python ----------
from compas.geometry import Plane
from compas_rhino.conversions import plane_to_rhino

plane = Plane(point, normal)
print(plane)

plane_rg = plane_to_rhino(plane)
# ---------- end plane ----------
point_cloud = Python3Script(num=number)  # -> out, points, points_rg; inputs num: Int32
# ---------- point_cloud: Python ----------
from random import random
from compas.geometry import Pointcloud, Point
from compas_rhino.conversions import point_to_rhino
    
# create point cloud within x and y bounds
cloud = Pointcloud.from_bounds(10, 5, 0, num)

# draw points of the pointcloud
points = [point for point in cloud]
points_rg = [point_to_rhino(point) for point in cloud]
# ---------- end point_cloud ----------
frame = Python3Script()  # -> out, frame, plane_rg
# ---------- frame: Python ----------
from compas.geometry import Frame, Point, Vector
from compas_rhino.conversions import frame_to_rhino

frame = Frame(Point(1, 2, 0), Vector.Yaxis(), Vector.Zaxis())
print(frame)

plane_rg = frame_to_rhino(frame)
# ---------- end frame ----------
pln = Plane(plane.plane_rg)
pln_2 = Plane(frame.plane_rg)

# ----
# 2D geometries
angle = Slider(75, range=0..180)
circle = Python3Script(frame=frame.frame, radius="2")  # -> out, circle_rg; inputs radius: Double
# ---------- circle: Python ----------
from compas.geometry import Circle
from compas_rhino.conversions import circle_to_rhino

circle = Circle(radius, frame)
circle_rg = circle_to_rhino(circle)
# ---------- end circle ----------
line = Python3Script()  # -> out, line_rg
# ---------- line: Python ----------
from compas.geometry import Line
from compas_rhino.conversions import line_to_rhino

line = Line([0, 0, 0], [1, 1, 1])
line_rg = line_to_rhino(line)
# ---------- end line ----------
line_2 = Line(line.line_rg)
circle_2 = Circle(circle.circle_rg)
arc = Python3Script(radius="3", end_angle=angle)  # -> out, arc_rg; inputs radius: Double, end_angle: Double
# ---------- arc: Python ----------
import math
from compas.geometry import Arc
from compas_rhino.conversions import arc_to_rhino

arc = Arc(radius=radius, start_angle=math.radians(0.0), end_angle=math.radians(end_angle))
print(arc.length)

arc_rg = arc_to_rhino(arc)
# ---------- end arc ----------
polyline = Python3Script(points=point_cloud.points)  # -> out, polyline_rg; inputs points: list
# ---------- polyline: Python ----------
from compas.geometry import Polyline
from compas_rhino.conversions import polyline_to_rhino_curve

polyline = Polyline(points)
polyline_rg = polyline_to_rhino_curve(polyline)

print(polyline.length)
print(polyline.lines)
# ---------- end polyline ----------
arc_2 = CircularArc(arc.arc_rg)
crv = Curve(polyline.polyline_rg)

# ----
# 3D geometries
sphere = Python3Script(points=point_cloud.points)  # -> out, spheres; inputs points: list
# ---------- sphere: Python ----------
from compas.geometry import Sphere
from compas_rhino.conversions import sphere_to_rhino

spheres = [sphere_to_rhino(Sphere(radius=0.2, point=point)) for point in points]
# ---------- end sphere ----------
box = Python3Script()  # -> out, box_rg
# ---------- box: Python ----------
from compas.geometry import Box
from compas_rhino.conversions import box_to_rhino

box = Box(1)
box_rg = box_to_rhino(box)
# ---------- end box ----------
cylinder = Python3Script()  # -> out, cylinder_rg
# ---------- cylinder: Python ----------
from compas.geometry import Cylinder, Frame, Point
from compas_rhino.conversions import cylinder_to_rhino_brep

frame = Frame(Point(0, -2, 0))
cylinder = Cylinder(frame=frame, radius=0.3, height=1.0)
cylinder_rg = cylinder_to_rhino_brep(cylinder)
# ---------- end cylinder ----------
box_2 = Box(box.box_rg)
brep = Brep(cylinder.cylinder_rg)
torus = Python3Script()  # -> out, torus_rg
# ---------- torus: Python ----------
from compas.geometry import Torus, Frame
from compas_rhino.conversions import torus_to_rhino_brep

torus = Torus(frame=Frame.worldXY(), radius_axis=10.0, radius_pipe=0.2)
torus_rg = torus_to_rhino_brep(torus)
# ---------- end torus ----------
cone = Python3Script()  # -> out, cone_rg
# ---------- cone: Python ----------
from compas.geometry import Cone, Frame, Point
from compas_rhino.conversions import cone_to_rhino_brep

frame = Frame(Point(-2, 0, 0))
cone = Cone(frame=frame, radius=0.3, height=1.0)
cone_rg = cone_to_rhino_brep(cone)
# ---------- end cone ----------
brep_2 = Brep(cone.cone_rg)
brep_3 = Brep(torus.torus_rg)
preview = CustomPreview(Geometry=brep_3, Material=ColourSwatch(SwatchColor=RGB(129, 220, 247)))
