# Grasshopper definition ex2-bauhaus-2d-shapes.ghx (Grasshopper 1.0.8)
# plug-ins: RhinoCodePluginGH

# ---- group: star
show = BooleanToggle(True)
star = Python3Script(show=show)  # -> star; inputs show: Double
# ---------- star: Python ----------
import math
from compas.geometry import Arc, Frame, Polygon

outline_side = 10
points = []
coordinates = [[-1, -1], [1, -1], [1, 1], [-1, 1]]

if show:
    start_angle = 0.0
    #draw arcs and put the points of the arc to a list
    for x, y in coordinates:
        center_frame = Frame([outline_side/2*x,outline_side/2*y,0], Frame.worldXY().xaxis, Frame.worldXY().yaxis)
        arc = Arc(radius=outline_side/2, start_angle=math.radians(start_angle), end_angle=math.radians(start_angle+90.0), frame=center_frame)
        points += arc.to_polyline(50).points[:-1]
        start_angle += 90.0
    print(len(points))
    #make a star polygon
    star = Polygon(points=points)
# ---------- end star ----------
transform = Python3Script(star=star)  # -> star
# ---------- transform: Python ----------
from compas.geometry import Translation

transform = True

#transform the desired location
if transform:
    star = star.transformed(Translation.from_vector([-20,0,0]))
# ---------- end transform ----------
vis = Python3Script(star=transform)  # -> star_mesh
# ---------- vis: Python ----------
from compas.datastructures import Mesh
from compas_rhino.conversions import mesh_to_rhino

#convert to compas mesh
star_compas_mesh = Mesh.from_polygons([star])
star_mesh = mesh_to_rhino(star_compas_mesh)
# ---------- end vis ----------
preview = CustomPreview(Geometry=vis, Material=ColourSwatch(SwatchColor=RGB(255, 0, 0)))

# ---- group: checkered squares
show_2 = BooleanToggle(True)
checkered_squares = Python3Script(show=show_2, division=Slider(4, range=1..10))  # -> squares; inputs division: Int32
# ---------- checkered_squares: Python ----------
from compas.geometry import Circle, Polygon

outline_side = 10
square_height = outline_side/division
squares = []
square_meshes = []

if show:
    # draw squares in a grid
    for i in range(division):
        for j in range(division):
            print(i, j)
            if i % 2 == 0 and j % 2 != 0 or i % 2 != 0 and j % 2 == 0:
                x = i * square_height - outline_side/2
                y = j * square_height - outline_side/2
                square = Polygon.from_rectangle(point=[x, y, 0], width=square_height, height=square_height)
                squares.append(square)
# ---------- end checkered_squares ----------

# ----
transform_2 = Python3Script(squares=checkered_squares)  # -> squares_t; inputs squares: list
# ---------- transform_2: Python ----------
from compas.geometry import Translation

transform = True
squares_t = []

#transform to desired location
if transform:
    for i, square in enumerate(squares):
        squares_t.append(square.transformed(Translation.from_vector([-20,-20,0])))
# ---------- end transform_2 ----------

# ---- group: checkered squares (continued)
vis_2 = Python3Script(squares=transform_2)  # -> square_meshes; inputs squares: list
# ---------- vis_2: Python ----------
from compas.datastructures import Mesh
from compas_rhino.conversions import circle_to_rhino, mesh_to_rhino

square_meshes = []

#transform to desired location
for square in squares:
    square_mesh = Mesh.from_polygons([square])
    square_meshes.append(mesh_to_rhino(square_mesh))
# ---------- end vis_2 ----------
preview_2 = CustomPreview(Geometry=vis_2, Material=ColourSwatch(SwatchColor=RGB(176, 140, 0)))

# ---- group: one circle
show_3 = BooleanToggle(True)
one_circle = Python3Script(show=show_3)  # -> circle
# ---------- one_circle: Python ----------
from compas.geometry import Circle

outline_side = 10

if show:
    #draw circle
    circle = Circle(outline_side/2)
# ---------- end one_circle ----------

# ----
transform_3 = Python3Script(circle=one_circle)  # -> circle
# ---------- transform_3: Python ----------
from compas.geometry import Translation

transform = True

if transform:
    circle = circle.transformed(Translation.from_vector([-20,20,0]))
# ---------- end transform_3 ----------

# ---- group: one circle (continued)
vis_3 = Python3Script(circle=transform_3)  # -> circle_mesh
# ---------- vis_3: Python ----------
from compas.datastructures import Mesh
from compas_rhino.conversions import circle_to_rhino, mesh_to_rhino

#convert to compas mesh
circle_compas_mesh = (Mesh.from_polygons([circle.to_polygon(50)]))
#convert to rhino mesh
circle_mesh = mesh_to_rhino(circle_compas_mesh)
# ---------- end vis_3 ----------
preview_3 = CustomPreview(Geometry=vis_3, Material=ColourSwatch(SwatchColor=RGB(0, 0, 255)))

# ---- group: arc lines
show_4 = BooleanToggle(True)
arc_lines = Python3Script(show=show_4, division=Slider(10, range=1..10))  # -> lines; inputs division: Int32
# ---------- arc_lines: Python ----------
import math
from compas.geometry import Arc, Line

outline_side = 10

lines = []

if show:
    #draw arc
    arc = Arc(radius=outline_side/2, start_angle=math.radians(0.0), end_angle=math.radians(90.0))
    #draw lines using its points
    for point in arc.to_polyline(n=division).points:
        line = Line([point[0],point[1],point[2]],[-point[0],-point[1],-point[2]])
        lines.append(line)
# ---------- end arc_lines ----------
linetype = ModelLinetype(<model linetype referenced from the Rhino model>)

# ----
transform_4 = Python3Script(lines=arc_lines)  # -> t_lines; inputs lines: list
# ---------- transform_4: Python ----------
from compas.geometry import Translation

t_lines = []
transform = True

#transform to desired location
if transform:
    for line in lines:
        line = line.transformed(Translation.from_vector([0,20,0]))
        t_lines.append(line)
# ---------- end transform_4 ----------
vis_4 = Python3Script(lines=transform_4)  # -> r_lines; inputs lines: list
# ---------- vis_4: Python ----------
from compas_rhino.conversions import line_to_rhino

r_lines = []

for line in lines:
    r_lines.append(line_to_rhino(line))
# ---------- end vis_4 ----------

# ---- group: arc lines (continued)
curve_preview = CustomCurvePreview(Curve=vis_4, Linetype=linetype, Colour=ColourSwatch(SwatchColor=RGB(255, 221, 53)))

# ---- group: concentric circles
show_5 = BooleanToggle(True)
concentric_circles = Python3Script(show=show_5, amount=Slider(5, range=1..10))  # -> circles; inputs amount: Int32
# ---------- concentric_circles: Python ----------
from compas.geometry import Circle

outline_side = 10

circles = []

if show:
    #draw circles until the outline
    for i in range(amount):
        radius = outline_side/2/amount
        circle = Circle((i+1)*radius)
        circles.append(circle)
# ---------- end concentric_circles ----------
linetype_2 = ModelLinetype(<model linetype referenced from the Rhino model>)

# ----
transform_5 = Python3Script(circles=concentric_circles)  # -> t_circles; inputs circles: list
# ---------- transform_5: Python ----------
from compas.geometry import Translation

t_circles = []

transform = True

for circle in circles:
    #transform to desired location
    if transform:
        circle = circle.transformed(Translation.from_vector([0,0,0]))
    t_circles.append(circle)
# ---------- end transform_5 ----------
vis_5 = Python3Script(circles=transform_5)  # -> r_circles; inputs circles: list
# ---------- vis_5: Python ----------
from compas_rhino.conversions import circle_to_rhino

r_circles = []

for circle in circles:
    r_circles.append(circle_to_rhino(circle))
# ---------- end vis_5 ----------

# ---- group: concentric circles (continued)
curve_preview_2 = CustomCurvePreview(Curve=vis_5, Linetype=linetype_2, Colour=ColourSwatch(SwatchColor=RGB(0, 0, 0)))

# ---- group: rhombus or more
show_6 = BooleanToggle(True)
rhombus = Python3Script(show=show_6, side=Slider(4, range=3..10))  # -> rhombus; inputs side: Int32
# ---------- rhombus: Python ----------
from compas.geometry import Polygon

outline_side = 10

if show:
    #draw rhombus
    rhombus = Polygon.from_sides_and_radius_xy(n=side, radius=5)
    rhombus.point = [-5,0,0]
# ---------- end rhombus ----------
transform_6 = Python3Script(rhombus=rhombus)  # -> rhombus
# ---------- transform_6: Python ----------
from compas.geometry import Translation

transform = True
#transform to desired location
if transform:
    rhombus = rhombus.transformed(Translation.from_vector([0,-20,0]))
# ---------- end transform_6 ----------

# ----
vis_6 = Python3Script(rhombus=transform_6)  # -> rhombus_mesh
# ---------- vis_6: Python ----------
from compas.datastructures import Mesh
from compas_rhino.conversions import mesh_to_rhino


#convert to compas mesh
rhombus_compas_mesh=Mesh.from_polygons([rhombus])
#convert to rhino mesh
rhombus_mesh = mesh_to_rhino(rhombus_compas_mesh)
# ---------- end vis_6 ----------

# ---- group: rhombus or more (continued)
preview_4 = CustomPreview(Geometry=vis_6, Material=ColourSwatch(SwatchColor=RGB(0, 0, 255)))

# ---- group: concentric arcs
show_7 = BooleanToggle(True)
concentric_arcs = Python3Script(show=show_7, amount=Slider(4, range=1..10))  # -> arcs; inputs show: Double, amount: Int32
# ---------- concentric_arcs: Python ----------
import math
from compas.geometry import Arc, Frame

outline_side = 10

arcs = []
center_frame = Frame([-outline_side/2,-outline_side/2,0], Frame.worldXY().xaxis, Frame.worldXY().yaxis)

if show:
    #draw arcs until outline
    for i in range(amount):
        radius = outline_side/amount
        arc = Arc(radius=(i+1)*radius, start_angle=math.radians(0.0), end_angle=math.radians(90.0), frame=center_frame)
        arcs.append(arc)
# ---------- end concentric_arcs ----------
linetype_3 = ModelLinetype(<model linetype referenced from the Rhino model>)

# ----
transform_7 = Python3Script(arcs=concentric_arcs)  # -> t_arcs; inputs arcs: list
# ---------- transform_7: Python ----------
from compas.geometry import Translation

t_arcs = []
transform = True

for arc in arcs:
    #transform to desired location
    if transform:
        arc = arc.transformed(Translation.from_vector([20,20,0]))
    t_arcs.append(arc)
# ---------- end transform_7 ----------
vis_7 = Python3Script(arcs=transform_7)  # -> r_arcs; inputs arcs: list
# ---------- vis_7: Python ----------
from compas_rhino.conversions import arc_to_rhino

r_arcs = []

for arc in arcs:
    r_arcs.append(arc_to_rhino(arc))
# ---------- end vis_7 ----------

# ---- group: concentric arcs (continued)
curve_preview_3 = CustomCurvePreview(Curve=vis_7, Linetype=linetype_3, Colour=ColourSwatch(SwatchColor=RGB(255, 0, 0)))

# ---- group: two half circles
show_8 = BooleanToggle(True)
two_half_circles = Python3Script(show=show_8)  # -> arc, arc_2; inputs show: Double
# ---------- two_half_circles: Python ----------
import math
from compas.geometry import Arc, Frame

outline_side = 10

if show:
    #draw first arc
    center_frame = Frame([0,0,0], Frame.worldXY().xaxis, Frame.worldXY().yaxis)
    arc = Arc(radius=outline_side/2, start_angle=math.radians(0.0), end_angle=math.radians(180.0), frame=center_frame)
    #draw second arc
    center_frame_2 = Frame([0,-outline_side/2,0], Frame.worldXY().xaxis, Frame.worldXY().yaxis)
    arc_2 = Arc(radius=outline_side/2, start_angle=math.radians(0.0), end_angle=math.radians(180.0), frame=center_frame_2)
# ---------- end two_half_circles ----------

# ----
transform_8 = Python3Script(arc=two_half_circles.arc, arc_2=two_half_circles.arc_2)  # -> arc, arc_2
# ---------- transform_8: Python ----------
from compas.geometry import Translation

transform = True

#transform to desired location
if transform:
    arc = arc.transformed(Translation.from_vector([20,0,0]))
    arc_2 = arc_2.transformed(Translation.from_vector([20,0,0]))
# ---------- end transform_8 ----------
vis_8 = Python3Script(arc=transform_8.arc, arc_2=transform_8.arc_2)  # -> arc_mesh, arc_mesh_2
# ---------- vis_8: Python ----------
from compas.datastructures import Mesh
from compas.geometry import Polygon
from compas_rhino.conversions import mesh_to_rhino


#convert the arcs to meshes
arc_compas_mesh = Mesh.from_polygons([Polygon(points=arc.to_polyline(n=50).points)])
arc_compas_mesh_2 = Mesh.from_polygons([Polygon(points=arc_2.to_polyline(n=50).points)])

#convert to rhino meshes
arc_mesh = mesh_to_rhino(arc_compas_mesh)
arc_mesh_2 = mesh_to_rhino(arc_compas_mesh_2)
# ---------- end vis_8 ----------

# ---- group: two half circles (continued)
preview_5 = CustomPreview(Geometry=vis_8.arc_mesh, Material=ColourSwatch(SwatchColor=RGB(0, 0, 0)))
preview_6 = CustomPreview(Geometry=vis_8.arc_mesh_2, Material=ColourSwatch(SwatchColor=RGB(176, 140, 0)))

# ---- group: straight lines
show_9 = BooleanToggle(True)
straight_lines = Python3Script(show=show_9, amount=Slider(10, range=2..10))  # -> lines; inputs amount: Int32
# ---------- straight_lines: Python ----------
from compas.geometry import Line

outline_side = 10

lines = []

if show:
    #draw lines
    for i in range(amount):
        distance = outline_side/(amount-1)
        line = Line([-outline_side/2, i*distance-5, 0], [outline_side/2, i*distance-5, 0])
        lines.append(line)
# ---------- end straight_lines ----------
linetype_4 = ModelLinetype(<model linetype referenced from the Rhino model>)

# ----
transform_9 = Python3Script(lines=straight_lines)  # -> t_lines; inputs lines: list
# ---------- transform_9: Python ----------
from compas.geometry import Translation

t_lines = []
transform = True

for line in lines:
    #transform to desired location
    if transform:
        line = line.transformed(Translation.from_vector([20,-20,0]))
    #convert to rhino line
    t_lines.append(line)
# ---------- end transform_9 ----------

# ---- group: straight lines (continued)
vis_9 = Python3Script(lines=transform_9)  # -> r_lines; inputs lines: list; same code as vis_4
curve_preview_4 = CustomCurvePreview(Curve=vis_9, Linetype=linetype_4, Colour=ColourSwatch(SwatchColor=RGB(255, 0, 0)))
