# Grasshopper definition ex3-bauhaus-3d-shapes.ghx (Grasshopper 1.0.8)
# plug-ins: RhinoCodePluginGH

show = BooleanToggle(True)
star = Python3Script(show=show)  # -> box, spheres; inputs show: Double
# ---------- star: Python ----------
import math
from compas.geometry import Box, Sphere

outline_side = 10
spheres = []

if show:
    box = Box(outline_side/4*3)
    for i in range(8):
        sphere = Sphere(outline_side/8*3, point=box.corner(i))
        spheres.append(sphere)
# ---------- end star ----------
transform = Python3Script(box=star.box, spheres=star.spheres, transform=Toggle(True))  # -> box, spheres_t; inputs spheres: list
# ---------- transform: Python ----------
from compas.geometry import Translation

spheres_t = []

#transform the desired location
if transform:
    box = box.transformed(Translation.from_vector([-20,0,0]))
    for sphere in spheres:
        #transform the desired location
        sphere = sphere.transformed(Translation.from_vector([-20,0,0]))
        spheres_t.append(sphere)
else:
    spheres_t = spheres
# ---------- end transform ----------
vis = Python3Script(box=transform.box, spheres=transform.spheres_t)  # -> star_mesh; inputs spheres: list
# ---------- vis: Python ----------
from compas.datastructures import Mesh
from compas_rhino.conversions import mesh_to_rhino
from Rhino.Geometry import Mesh as Mesh_rg

sphere_meshes = []

#convert box to compas mesh
box_compas_mesh = Mesh.from_shape(box)
box_mesh = mesh_to_rhino(box_compas_mesh)

for sphere in spheres:
    #convert spheres to compas mesh
    sphere_compas_mesh = Mesh.from_shape(sphere)
    sphere_mesh = mesh_to_rhino(sphere_compas_mesh)
    sphere_meshes.append(sphere_mesh)

#boolean operation
star_mesh = Mesh_rg.CreateBooleanDifference([box_mesh], sphere_meshes)
# ---------- end vis ----------
preview = CustomPreview(Geometry=vis, Material=ColourSwatch(SwatchColor=RGBA(255, 0, 0, 157)))

show_2 = BooleanToggle(True)
list = ValueList({"4", "6", "8", "12", "20"}, selected="8")
octahedron = Python3Script(show=show_2, side=list)  # -> octahedron; inputs side: Int32
# ---------- octahedron: Python ----------
from compas.geometry import Polyhedron

outline_side = 10

if show:
    #draw octahedron
    octahedron = Polyhedron.from_platonicsolid(side)
    octahedron.point = [-outline_side/2,0,0]
    octahedron.scale(5)
# ---------- end octahedron ----------
transform_2 = Python3Script(octahedron=octahedron, transform=Toggle(True))  # -> octahedron
# ---------- transform_2: Python ----------
from compas.geometry import Translation

#transform to desired location
if transform:
    octahedron = octahedron.transformed(Translation.from_vector([0,-20,0]))
# ---------- end transform_2 ----------
vis_2 = Python3Script(octahedron=transform_2)  # -> octahedron_mesh
# ---------- vis_2: Python ----------
from compas.datastructures import Mesh
from compas_rhino.conversions import polyhedron_to_rhino

#convert to rhino mesh
octahedron_mesh = polyhedron_to_rhino(octahedron)
# ---------- end vis_2 ----------
preview_2 = CustomPreview(Geometry=vis_2, Material=ColourSwatch(SwatchColor=RGBA(0, 0, 255, 196)))

show_3 = BooleanToggle(True)
number = Slider(119, range=10..200)
point_cloud = Python3Script(show=show_3, num=number)  # -> spheres; inputs num: Int32
# ---------- point_cloud: Python ----------
from random import random
from compas.geometry import Pointcloud, Point, Sphere
from compas_rhino.conversions import point_to_rhino

outline_side = 10


# create point cloud within x and y bounds
bounds = (-outline_side/2,outline_side/2)
cloud = Pointcloud.from_bounds(bounds, bounds, bounds, num)

# draw points of the pointcloud
spheres = [Sphere(radius=0.5, point=point) for point in cloud]
# ---------- end point_cloud ----------
transform_3 = Python3Script(spheres=point_cloud, transform=Toggle(True))  # -> t_spheres; inputs spheres: list
# ---------- transform_3: Python ----------
from compas.geometry import Translation

t_spheres = []

#transform to desired location
if transform:
    for sphere in spheres:
        sphere = sphere.transformed(Translation.from_vector([20,20,0]))
        t_spheres.append(sphere)
else:
    t_spheres = spheres
# ---------- end transform_3 ----------
vis_3 = Python3Script(spheres=transform_3)  # -> t_spheres; inputs spheres: list
# ---------- vis_3: Python ----------
from compas.datastructures import Mesh
from compas_rhino.conversions import mesh_to_rhino

t_spheres = []

for sphere in spheres:
    sphere_mesh = Mesh.from_shape(sphere)
    t_spheres.append(mesh_to_rhino(sphere_mesh))
# ---------- end vis_3 ----------
preview_3 = CustomPreview(Geometry=vis_3, Material=ColourSwatch(SwatchColor=RGBA(255, 0, 0, 186)))

show_4 = BooleanToggle(True)
cone = Python3Script(show=show_4)  # -> cone, surface
# ---------- cone: Python ----------
from compas.geometry import Cone, Frame, Point, Polygon
from compas.datastructures import Mesh

outline_side = 10

if show:
    frame = Frame(Point(0, 0, -outline_side/2))
    cone = Cone(frame=frame, radius=outline_side/2, height=outline_side)
    surface = Mesh.from_polygons([Polygon([[outline_side/2,outline_side/2,0],[outline_side/2,-outline_side/2,0],
                                    [-outline_side/2,-outline_side/2,0],[-outline_side/2,outline_side/2,0]])])
# ---------- end cone ----------
transform_4 = Python3Script(cone=cone.cone, surface=cone.surface, transform=Toggle(True))  # -> cone, surface
# ---------- transform_4: Python ----------
from compas.geometry import Translation

#transform to desired location
if transform:
    cone = cone.transformed(Translation.from_vector([20,0,0]))
    surface = surface.transformed(Translation.from_vector([20,0,0]))
# ---------- end transform_4 ----------
vis_4 = Python3Script(cone=transform_4.cone, surface=transform_4.surface, move=Toggle(True))  # -> meshes
# ---------- vis_4: Python ----------
from compas.datastructures import Mesh
from compas.geometry import Polygon, Translation
from compas_rhino.conversions import mesh_to_rhino, cone_to_rhino_brep, brep_to_rhino, mesh_to_compas
from Rhino.Geometry import Mesh as Mesh_rg

#convert to rhino meshes
cone_mesh = mesh_to_rhino(Mesh.from_shape(cone))
surface_mesh = mesh_to_rhino(surface)

#split cone mesh with surface mesh
meshes = cone_mesh.Split([surface_mesh])

if move:
    #translate the upper mesh
    compas_mesh = mesh_to_compas(meshes[1])
    compas_mesh.transform(Translation.from_vector([0,0,2]))
    meshes[1] = mesh_to_rhino(compas_mesh)
# ---------- end vis_4 ----------
preview_4 = CustomPreview(Geometry=vis_4, Material=ColourSwatch(SwatchColor=RGB(176, 140, 0)))

py3 = Python3Script()  # -> out, a
# ---------- py3: Python ----------
from compas.geometry import Box
from compas.geometry import Sphere
from compas.geometry import Polyhedron

import compas_cgal
from compas.geometry import trimesh_remesh

# ==============================================================================
# Make a box and a sphere
# ==============================================================================

box = Box(2)
A = box.to_vertices_and_faces(triangulated=True)

sphere = Sphere(1, point=[1, 1, 1])
B = sphere.to_vertices_and_faces(u=32, v=32, triangulated=True)

# ==============================================================================
# Remesh the sphere
# ==============================================================================

B = trimesh_remesh(B, 0.3, 50)

# ==============================================================================
# Compute the boolean mesh
# ==============================================================================

V, F = boolean_union_mesh_mesh(A, B)
shape = Polyhedron(V.tolist(), F.tolist())  # revise the Shape API
# ---------- end py3 ----------

show_5 = BooleanToggle(True)
checkered_boxes = Python3Script(show=show_5, division=Slider(4, range=2..10))  # -> boxes; inputs division: Int32
# ---------- checkered_boxes: Python ----------
from compas.geometry import Box, Polygon, Frame

outline_side = 10
box_height = outline_side/division
boxes = []

if show:
    # draw squares in a grid
    for i in range(division):
        for j in range(division):
            for k in range(division):
                if i % 2 == 0 and j % 2 != 0 and k % 2 == 0 or i % 2 != 0 and j % 2 == 0 and k % 2 == 0 or i % 2 == 0 and j % 2 == 0 and k % 2 != 0 or i % 2 != 0 and j % 2 != 0 and k % 2 != 0:
                    x = i * box_height - outline_side*3/8
                    y = j * box_height - outline_side*3/8
                    z = k * box_height - outline_side*3/8
                    frame = Frame(point=[x,y,z])
                    box = Box(box_height,frame=frame)
                    boxes.append(box)
# ---------- end checkered_boxes ----------

transform_5 = Python3Script(boxes=checkered_boxes, transform=Toggle(True))  # -> t_boxes; inputs boxes: list
# ---------- transform_5: Python ----------
from compas.geometry import Translation

t_boxes = []

#transform to desired location
if transform:
    for box in boxes:
        box = box.transformed(Translation.from_vector([-20,-20,0]))
        t_boxes.append(box)
else:
    t_boxes = boxes
# ---------- end transform_5 ----------
vis_5 = Python3Script(boxes=transform_5)  # -> t_boxes; inputs boxes: list
# ---------- vis_5: Python ----------
from compas.datastructures import Mesh
from compas_rhino.conversions import box_to_rhino

t_boxes = []

#transform to desired location
for box in boxes:
    t_boxes.append(box_to_rhino(box))
# ---------- end vis_5 ----------

preview_5 = CustomPreview(Geometry=vis_5, Material=ColourSwatch(SwatchColor=RGB(176, 140, 0)))

show_6 = BooleanToggle(True)
torus_and_spheres = Python3Script(show=show_6, amount=Slider(3, range=2..10))  # -> spheres, torus; inputs amount: Int32
# ---------- torus_and_spheres: Python ----------
from compas.geometry import Sphere, Torus

outline_side = 10
spheres = []

if show:
    #draw torus
    torus = Torus(radius_axis=outline_side/2, radius_pipe=1)
    distance = outline_side/amount
    radius = outline_side/(amount*2.5)
    #draw sphere
    for i in range(amount):
        sphere = Sphere(radius=radius, point=[0,0,i*distance-3])
        spheres.append(sphere)
# ---------- end torus_and_spheres ----------
transform_6 = Python3Script(spheres=torus_and_spheres.spheres, torus=torus_and_spheres.torus, transform=Toggle(True))  # -> t_spheres, t_torus; inputs spheres: list
# ---------- transform_6: Python ----------
from compas.geometry import Translation

t_spheres = []

#transform to desired location
if transform:
    for sphere in spheres:
        sphere = sphere.transformed(Translation.from_vector([-20,20,0]))
        t_spheres.append(sphere)
    t_torus = torus.transformed(Translation.from_vector([-20,20,0]))
else:
    t_torus = torus
    t_spheres = spheres
# ---------- end transform_6 ----------

vis_6 = Python3Script(spheres=transform_6.t_spheres, torus=transform_6.t_torus)  # -> t_spheres, t_torus; inputs spheres: list
# ---------- vis_6: Python ----------
from compas.datastructures import Mesh
from compas_rhino.conversions import sphere_to_rhino, torus_to_rhino

t_spheres = []

for sphere in spheres:
    t_spheres.append(sphere_to_rhino(sphere))

#convert to rhino mesh
t_torus = torus_to_rhino(torus)
# ---------- end vis_6 ----------

preview_6 = CustomPreview(Geometry=vis_6.t_spheres, Material=ColourSwatch(SwatchColor=RGBA(233, 195, 255, 166)))
preview_7 = CustomPreview(Geometry=vis_6.t_torus, Material=ColourSwatch(SwatchColor=RGBA(0, 0, 255, 166)))

show_7 = BooleanToggle(True)
concentric_spheres = Python3Script(show=show_7, amount=Slider(5, range=1..10))  # -> spheres; inputs amount: Int32
# ---------- concentric_spheres: Python ----------
from compas.geometry import Sphere

outline_side = 10

spheres = []

if show:
    #draw circles until the outline
    for i in range(amount):
        radius = outline_side/2/amount
        sphere = Sphere(radius=(i+1)*radius, point=[0,0,0])
        spheres.append(sphere)
# ---------- end concentric_spheres ----------

vis_7 = Python3Script(spheres=concentric_spheres)  # -> t_spheres; inputs spheres: list; same code as vis_3

preview_8 = CustomPreview(Geometry=vis_7, Material=ColourSwatch(SwatchColor=RGBA(0, 0, 0, 52)))

show_8 = BooleanToggle(True)
arc_polygons = Python3Script(show=show_8, division=Slider(5, range=1..10))  # -> polygons; inputs division: Int32
# ---------- arc_polygons: Python ----------
import math
from compas.geometry import Arc, Polygon

outline_side = 10

polygons = []

if show:
    #draw arc
    arc = Arc(radius=outline_side/2, start_angle=math.radians(0.0), end_angle=math.radians(90.0))
    #draw lines using its points
    for point in arc.to_polyline(n=division).points:
        polygon = Polygon([[point[0],point[1],point[2]],[-point[0],-point[1],-point[2]],
                            [-point[0],-point[1],-point[2]-outline_side/2],[point[0],point[1],point[2]-outline_side/2]])
        polygons.append(polygon)
# ---------- end arc_polygons ----------
transform_7 = Python3Script(polygons=arc_polygons, transform=Toggle(True))  # -> t_polygons; inputs polygons: list
# ---------- transform_7: Python ----------
from compas.geometry import Translation

t_polygons = []

#transform to desired location
if transform:
    for polygon in polygons:
        polygon = polygon.transformed(Translation.from_vector([0,20,0]))
        t_polygons.append(polygon)
else:
    t_polygons = polygons
# ---------- end transform_7 ----------

vis_8 = Python3Script(polygons=transform_7)  # -> meshes; inputs polygons: list
# ---------- vis_8: Python ----------
from compas.datastructures import Mesh
from compas_rhino.conversions import mesh_to_rhino

meshes = []

for polygon in polygons:
    meshes.append(mesh_to_rhino(Mesh.from_polygons([polygon])))
# ---------- end vis_8 ----------

preview_9 = CustomPreview(Geometry=vis_8, Material=ColourSwatch(SwatchColor=RGB(255, 238, 0)))

show_9 = BooleanToggle(True)
half_sphere_lines = Python3Script(show=show_9)  # -> lines
# ---------- half_sphere_lines: Python ----------
from compas.geometry import Line, Sphere, Plane, Vector, project_point_plane
from compas.datastructures import Mesh

outline_side = 10

lines = []

if show:
    sphere = Sphere(radius=outline_side/2, point=[0,0,0])
    plane = Plane(point=[0,0,-outline_side/2], normal=Vector.Zaxis())

    points = [Mesh.from_shape(sphere).vertex_coordinates(vertex) for vertex in Mesh.from_shape(sphere).vertices()]
    for point in points:
        if point[2] >= 0:
            print(point)
            projected_point = project_point_plane(point, plane)
            print(projected_point)
            line = Line(point, projected_point)
            lines.append(line)
# ---------- end half_sphere_lines ----------
linetype = ModelLinetype(<model linetype referenced from the Rhino model>)

transform_8 = Python3Script(lines=half_sphere_lines, transform=Toggle(True))  # -> t_lines; inputs lines: list
# ---------- transform_8: Python ----------
from compas.geometry import Translation

t_lines = []

#transform to desired location
if transform:
    for line in lines:
        line = line.transformed(Translation.from_vector([20,-20,0]))
        t_lines.append(line)
else:
    t_lines = lines
# ---------- end transform_8 ----------
vis_9 = Python3Script(lines=transform_8)  # -> t_lines; inputs lines: list
# ---------- vis_9: Python ----------
from compas_rhino.conversions import line_to_rhino

t_lines = []

for line in lines:
    #convert to rhino line
    t_lines.append(line_to_rhino(line))
# ---------- end vis_9 ----------

curve_preview = CustomCurvePreview(Curve=vis_9, Linetype=linetype, Colour=ColourSwatch(SwatchColor=RGB(95, 158, 163)))
