# Grasshopper definition ex3-happy-face.gh (Grasshopper 1.0.8)
# plug-ins: RhinoCodePluginGH

# ----
# Happy face
show = BooleanToggle(True)
face = ColourSwatch(SwatchColor=RGB(212, 179, 91))
eyes = ColourSwatch(SwatchColor=RGB(123, 168, 19))
mouth = ColourSwatch(SwatchColor=RGB(227, 59, 59))
_2d_animal = Python3Script(
    face_color=face,
    eye_size=Slider(4, range=1..6),
    eye_spacing=Slider(10, range=3..12),
    eye_color=eyes,
    mouth_height=Slider(-3, range=-3..3),
    mouth_width=Slider(10, range=1..10),
    mouth_color=mouth,
    nose_location=Slider(-2, range=-3..0),
    show=show)  # -> out, geometries, meshes; inputs face_color: Color
# ---------- _2d_animal: Python ----------
from compas.geometry import Point, Vector, Frame, Line, Circle, Polygon, Polyline, Arc
from compas.datastructures import Mesh
from compas.colors import Color
import math
from compas_rhino.conversions import circle_to_rhino_curve, mesh_to_rhino, polyline_to_rhino, arc_to_rhino
from compas.colors import Color

# Draw face outline
face_size = 20
face = Circle(radius=face_size/2, frame=Frame(Point(0, 0, 0), Vector(1, 0, 0), Vector(0, 1, 0)))

# Draw face mesh
face_mesh = Mesh.from_polygons([face.to_polygon(50)])
face_color = Color.from_rgb255(face_color.R, face_color.G, face_color.B)

# Draw eyes outline
eye_height = 2
eye_color = Color.from_rgb255(eye_color.R, eye_color.G, eye_color.B)
eye1_x = -eye_spacing / 2
eye2_x = eye_spacing / 2
eye1_y = eye2_y = 0.25

eye_size_inside = eye_size / 5
eye_displacement = eye_size_inside * 2
eye_color_inside = Color.black()
angle = 0
eye1_x_inside = eye1_x - (eye_displacement*math.cos(angle))
eye2_x_inside = eye2_x - (eye_displacement*math.cos(angle))
eye1_y_inside = eye1_y - (eye_displacement*math.sin(angle))
eye2_y_inside = eye2_y - (eye_displacement*math.sin(angle))

eye1 = Circle(radius=eye_size, frame=Frame(Point(eye1_x, eye1_y, 0.01), Vector(1, 0, 0), Vector(0, 1, 0)))
eye2 = Circle(radius=eye_size, frame=Frame(Point(eye2_x, eye2_y, 0.01), Vector(1, 0, 0), Vector(0, 1, 0)))
eye1_inside = Circle(radius=eye_size/5, frame=Frame(Point(eye1_x_inside, eye1_y_inside, 0.02), Vector(1, 0, 0), Vector(0, 1, 0)))
eye2_inside = Circle(radius=eye_size/5, frame=Frame(Point(eye2_x_inside, eye2_y_inside, 0.02), Vector(1, 0, 0), Vector(0, 1, 0)))

# Draw eyes mesh
eyes_mesh = Mesh.from_polygons([eye1.to_polygon(50), eye2.to_polygon(50)])
eyes_inside_mesh = Mesh.from_polygons([eye1_inside.to_polygon(50), eye2_inside.to_polygon(50)])

# Draw mouth
mouth_location = -5
mouth_color = Color.from_rgb255(mouth_color.R, mouth_color.G, mouth_color.B)

# Draw mouth mesh
mouth = Polyline([[-mouth_width/2,mouth_location,0.01], [mouth_width/2,mouth_location,0.01], [0,mouth_location+mouth_height-0.001,0.01],[-mouth_width/2,mouth_location,0.01]])
mouth_mesh = Mesh.from_polygons([mouth.to_polygon(50)])

# Draw nose
nose = Arc(radius=1.5, start_angle=math.radians(270), end_angle=math.radians(360), frame=Frame(Point(-1.5, nose_location, 0.01), Vector(1, 0, 0), Vector(0, 1, 0)))

# Convert compas to rhino and add to geometries
if show:
    geometries = [circle_to_rhino_curve(face), circle_to_rhino_curve(eye1), circle_to_rhino_curve(eye2), circle_to_rhino_curve(eye1_inside), circle_to_rhino_curve(eye2_inside), polyline_to_rhino(mouth), arc_to_rhino(nose)]
    meshes = [mesh_to_rhino(face_mesh, color=face_color), mesh_to_rhino(eyes_mesh, color=eye_color), mesh_to_rhino(eyes_inside_mesh, color=eye_color_inside), mesh_to_rhino(mouth_mesh, color=mouth_color)]
# ---------- end _2d_animal ----------
preview = CustomPreview(Geometry=_2d_animal.geometries, Material=ColourSwatch(SwatchColor=RGB(0, 0, 0)))
