# Grasshopper definition ex5-bauhaus-3d-shapes.gh (Grasshopper 1.0.8)
# plug-ins: RhinoCodePluginGH

show = BooleanToggle(True)
half_spheres = Python3Script(show=show)  # -> sphere
# ---------- half_spheres: Python ----------
from compas.geometry import Sphere
from compas.datastructures import Mesh
from compas_rhino.conversions import sphere_to_rhino, mesh_to_rhino

outline_side = 10

if show:
    #draw sphere
    sphere = Sphere(radius=outline_side/2, point=[0,0,0])

    sphere_mesh = Mesh.from_shape(sphere)
    print(sphere_mesh.to_points())
    sphere = mesh_to_rhino(sphere_mesh)
# ---------- end half_spheres ----------
transform = Python3Script(spheres=half_spheres)  # -> sphere_meshes
# ---------- transform: Python ----------
from compas.geometry import Translation
from compas.datastructures import Mesh
from compas_rhino.conversions import sphere_to_rhino, mesh_to_rhino

transform = True

#convert to compas mesh
circle_compas_mesh = (Mesh.from_polygons([circle.to_polygon(50)]))
#transform to desired location
if transform:
    circle_compas_mesh.transform(Translation.from_vector([-20,20,0]))
#convert to rhino mesh
circle_mesh = mesh_to_rhino(circle_compas_mesh)
# ---------- end transform ----------
preview = CustomPreview(Geometry=half_spheres, Material=ColourSwatch(SwatchColor=RGBA(233, 195, 255, 166)))

show_2 = BooleanToggle(True)
star = Python3Script(show=show_2)  # -> star; inputs show: Double
# ---------- star: Python ----------
import math
from compas.geometry import Arc, Frame, Polygon

outline_side = 10
points = []
coordinates = [[-1, -1], [1, -1], [1, 1], [-1, 1]]

if show:
    start_angle = 0.0
    #draw arcs and put the points of the arc to a list
    for x, y in coordinates:
        center_frame = Frame([outline_side/2*x,outline_side/2*y,0], Frame.worldXY().xaxis, Frame.worldXY().yaxis)
        arc = Arc(radius=outline_side/2, start_angle=math.radians(start_angle), end_angle=math.radians(start_angle+90.0), frame=center_frame)
        points += arc.to_polyline(50).points[:-1]
        start_angle += 90.0
    print(len(points))
    #make a star polygon
    star = Polygon(points=points)
# ---------- end star ----------
transform_2 = Python3Script(star=star)  # -> star_mesh
# ---------- transform_2: Python ----------
import math
from compas.geometry import Translation
from compas.datastructures import Mesh
from compas_rhino.conversions import mesh_to_rhino

transform = True

#convert to compas mesh
star_compas_mesh = Mesh.from_polygons([star])
#transform the desired location
if transform:
    star_compas_mesh.transform(Translation.from_vector([-20,0,0]))
star_mesh = mesh_to_rhino(star_compas_mesh)
# ---------- end transform_2 ----------
preview_2 = CustomPreview(Geometry=transform_2, Material=ColourSwatch(SwatchColor=RGB(255, 0, 0)))

sphere = Python3Script()  # -> out, spheres; inputs points: list
# ---------- sphere: Python ----------
from compas.geometry import Sphere
from compas_rhino.conversions import sphere_to_rhino

spheres = [sphere_to_rhino(Sphere(radius=0.2, point=point)) for point in points]
# ---------- end sphere ----------

show_3 = BooleanToggle(True)
rhombus = Python3Script(show=show_3)  # -> rhombus
# ---------- rhombus: Python ----------
from compas.geometry import Polygon

outline_side = 10

if show:
    #draw rhombus
    rhombus = Polygon.from_sides_and_radius_xy(n=4, radius=5)
    rhombus.point = [-5,0,0]
# ---------- end rhombus ----------
transform_3 = Python3Script(rhombus=rhombus)  # -> rhombus_mesh
# ---------- transform_3: Python ----------
from compas.geometry import Translation
from compas.datastructures import Mesh
from compas_rhino.conversions import mesh_to_rhino

transform = True

#convert to compas mesh
rhombus_compas_mesh=Mesh.from_polygons([rhombus])
#transform to desired location
if transform:
    rhombus_compas_mesh.transform(Translation.from_vector([0,-20,0]))
#convert to rhino mesh
rhombus_mesh = mesh_to_rhino(rhombus_compas_mesh)
# ---------- end transform_3 ----------
preview_3 = CustomPreview(Geometry=transform_3, Material=ColourSwatch(SwatchColor=RGB(0, 0, 255)))

show_4 = BooleanToggle(True)
checkered_squares = Python3Script(show=show_4, division="4")  # -> squares; inputs division: Int32
# ---------- checkered_squares: Python ----------
from compas.geometry import Circle, Polygon

outline_side = 10
square_height = outline_side/division
squares = []
square_meshes = []

if show:
    # draw squares in a grid
    for i in range(division):
        for j in range(division):
            print(i, j)
            if i % 2 == 0 and j % 2 != 0 or i % 2 != 0 and j % 2 == 0:
                x = i * square_height - outline_side/2
                y = j * square_height - outline_side/2
                square = Polygon.from_rectangle(point=[x, y, 0], width=square_height, height=square_height)
                squares.append(square)
# ---------- end checkered_squares ----------

transform_4 = Python3Script(squares=checkered_squares)  # -> square_meshes; inputs squares: list
# ---------- transform_4: Python ----------
from compas.geometry import Translation
from compas.datastructures import Mesh
from compas_rhino.conversions import circle_to_rhino, mesh_to_rhino

transform = True
square_meshes = []

#transform to desired location
for square in squares:
    square_mesh = Mesh.from_polygons([square])
    if transform:
        square_mesh.transform(Translation.from_vector([-20,-20,0]))
    square_meshes.append(mesh_to_rhino(square_mesh))
# ---------- end transform_4 ----------

preview_4 = CustomPreview(Geometry=transform_4, Material=ColourSwatch(SwatchColor=RGB(176, 140, 0)))

show_5 = BooleanToggle(True)
concentric_spheres = Python3Script(show=show_5)  # -> spheres
# ---------- concentric_spheres: Python ----------
from compas.geometry import Sphere

outline_side = 10

spheres = []

if show:
    #draw circles until the outline
    for radius in range(int(outline_side/2)):
        sphere = Sphere(radius=radius+1, point=[0,0,0])
        spheres.append(sphere)
# ---------- end concentric_spheres ----------

transform_5 = Python3Script(spheres=concentric_spheres)  # -> t_spheres; inputs spheres: list
# ---------- transform_5: Python ----------
from compas.geometry import Translation
from compas.datastructures import Mesh
from compas_rhino.conversions import mesh_to_rhino

t_spheres = []

transform = True

for sphere in spheres:
    sphere_mesh = Mesh.from_shape(sphere)
    #transform to desired location
    if transform:
        sphere_mesh = sphere_mesh.transformed(Translation.from_vector([0,0,0]))
    t_spheres.append(mesh_to_rhino(sphere_mesh))
# ---------- end transform_5 ----------

preview_5 = CustomPreview(Geometry=transform_5, Material=ColourSwatch(SwatchColor=RGBA(0, 0, 0, 52)))

show_6 = BooleanToggle(True)
arc_lines = Python3Script(show=show_6)  # -> lines
# ---------- arc_lines: Python ----------
import math
from compas.geometry import Arc, Line

outline_side = 10

lines = []

if show:
    #draw arc
    arc = Arc(radius=outline_side/2, start_angle=math.radians(0.0), end_angle=math.radians(90.0))
    #draw lines using its points
    for point in arc.to_polyline(n=10).points:
        line = Line([point[0],point[1],point[2]],[-point[0],-point[1],-point[2]])
        lines.append(line)
# ---------- end arc_lines ----------
linetype = ModelLinetype(<model linetype referenced from the Rhino model>)

transform_6 = Python3Script(lines=arc_lines)  # -> t_lines; inputs lines: list
# ---------- transform_6: Python ----------
import math
from compas.geometry import Translation
from compas_rhino.conversions import line_to_rhino

outline_side = 10

t_lines = []
transform = True

for line in lines:
    #transform to desired location
    if transform:
        line = line.transformed(Translation.from_vector([0,20,0]))
    t_lines.append(line_to_rhino(line))
# ---------- end transform_6 ----------

curve_preview = CustomCurvePreview(Curve=transform_6, Linetype=linetype, Colour=ColourSwatch(SwatchColor=RGB(255, 221, 53)))

show_7 = BooleanToggle(True)
concentric_arcs = Python3Script(show=show_7)  # -> arcs; inputs show: Double
# ---------- concentric_arcs: Python ----------
import math
from compas.geometry import Arc, Frame

outline_side = 10

arcs = []
center_frame = Frame([-outline_side/2,-outline_side/2,0], Frame.worldXY().xaxis, Frame.worldXY().yaxis)

if show:
    #draw arcs until outline
    for radius in range(int(outline_side/2)):
        arc = Arc(radius=radius*2+2, start_angle=math.radians(0.0), end_angle=math.radians(90.0), frame=center_frame)
        arcs.append(arc)
# ---------- end concentric_arcs ----------
linetype_2 = ModelLinetype(<model linetype referenced from the Rhino model>)

transform_7 = Python3Script(arcs=concentric_arcs)  # -> t_arcs; inputs arcs: list
# ---------- transform_7: Python ----------
import math
from compas.geometry import Translation
from compas_rhino.conversions import arc_to_rhino

t_arcs = []
transform = True

for arc in arcs:
    #transform to desired location
    if transform:
        arc = arc.transformed(Translation.from_vector([20,20,0]))
    t_arcs.append(arc_to_rhino(arc))
# ---------- end transform_7 ----------

curve_preview_2 = CustomCurvePreview(Curve=transform_7, Linetype=linetype_2, Colour=ColourSwatch(SwatchColor=RGB(255, 0, 0)))

show_8 = BooleanToggle(True)
two_half_circles = Python3Script(show=show_8)  # -> arc, arc_2; inputs show: Double
# ---------- two_half_circles: Python ----------
import math
from compas.geometry import Arc, Frame

outline_side = 10

if show:
    #draw first arc
    center_frame = Frame([0,0,0], Frame.worldXY().xaxis, Frame.worldXY().yaxis)
    arc = Arc(radius=outline_side/2, start_angle=math.radians(0.0), end_angle=math.radians(180.0), frame=center_frame)
    #draw second arc
    center_frame_2 = Frame([0,-outline_side/2,0], Frame.worldXY().xaxis, Frame.worldXY().yaxis)
    arc_2 = Arc(radius=outline_side/2, start_angle=math.radians(0.0), end_angle=math.radians(180.0), frame=center_frame_2)
# ---------- end two_half_circles ----------

transform_8 = Python3Script(arc=two_half_circles.arc, arc_2=two_half_circles.arc_2)  # -> arc_mesh, arc_mesh_2
# ---------- transform_8: Python ----------
import math
from compas.datastructures import Mesh
from compas.geometry import Polygon, Translation
from compas_rhino.conversions import mesh_to_rhino

transform = True

#convert the arcs to meshes
arc_compas_mesh = Mesh.from_polygons([Polygon(points=arc.to_polyline(n=50).points)])
arc_compas_mesh_2 = Mesh.from_polygons([Polygon(points=arc_2.to_polyline(n=50).points)])
#transform to desired location
if transform:
    arc_compas_mesh.transform(Translation.from_vector([20,0,0]))
    arc_compas_mesh_2.transform(Translation.from_vector([20,0,0]))
#convert to rhino meshes
arc_mesh = mesh_to_rhino(arc_compas_mesh)
arc_mesh_2 = mesh_to_rhino(arc_compas_mesh_2)
# ---------- end transform_8 ----------

preview_6 = CustomPreview(Geometry=transform_8.arc_mesh, Material=ColourSwatch(SwatchColor=RGB(176, 140, 0)))
preview_7 = CustomPreview(Geometry=transform_8.arc_mesh_2, Material=ColourSwatch(SwatchColor=RGB(0, 0, 0)))

show_9 = BooleanToggle(True)
straight_lines = Python3Script(show=show_9)  # -> lines
# ---------- straight_lines: Python ----------
from compas.geometry import Line

outline_side = 10

lines = []

if show:
    #draw lines
    for course in range(outline_side+1):
        line = Line([-outline_side/2, course-5, 0], [outline_side/2, course-5, 0])
        lines.append(line)
# ---------- end straight_lines ----------
linetype_3 = ModelLinetype(<model linetype referenced from the Rhino model>)

transform_9 = Python3Script(lines=straight_lines)  # -> t_lines; inputs lines: list
# ---------- transform_9: Python ----------
from compas.geometry import Translation
from compas_rhino.conversions import line_to_rhino

t_lines = []
transform = True

for line in lines:
    #transform to desired location
    if transform:
        line = line.transformed(Translation.from_vector([20,-20,0]))
    #convert to rhino line
    t_lines.append(line_to_rhino(line))
# ---------- end transform_9 ----------

curve_preview_3 = CustomCurvePreview(Curve=transform_9, Linetype=linetype_3, Colour=ColourSwatch(SwatchColor=RGB(255, 0, 0)))
