# Grasshopper definition ex1-frames-and-transformations.ghx (Grasshopper 1.0.8)
# plug-ins: RhinoCodePluginGH

# ---- group: transform box from frame world XY to frame
crv = Curve(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)
crv_2 = Curve(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)
pt = Point(Point(-11.25160869, 22.08724197, 25.91983455))
vec = Vector(crv_2)
vec_2 = Vector(crv)
transform_box = Python3Script(point=pt, xaxis=vec, yaxis=vec_2)  # -> box_in_frame_1, box_in_frame_2; inputs point: Point3d
# ---------- transform_box: Python ----------
"""Example: Bring a box from the world coordinate system into another coordinate system.
"""
from compas.geometry import Frame
from compas.geometry import Transformation
from compas.geometry import Box
from compas.datastructures import Mesh
from compas_rhino.conversions import frame_to_rhino, point_to_compas, vector_to_compas, mesh_to_rhino


# Box in Frame 1
F1 = Frame.worldXY()
width, length, height = 10, 10, 10
box = Box(width, length, height, F1)

# Draw mesh
mesh = box.to_mesh()
box_in_frame_1 = mesh_to_rhino(mesh)

# Frame 2
point = point_to_compas(point)
xaxis = vector_to_compas(xaxis)
yaxis = vector_to_compas(yaxis)

F2 = Frame(point, xaxis, yaxis)

T = Transformation.from_frame(F2)
mesh2 = mesh.transformed(T)

box_in_frame_2 = mesh_to_rhino(mesh2)
# ---------- end transform_box ----------
mesh = Mesh(transform_box.box_in_frame_2)
mesh_2 = Mesh(transform_box.box_in_frame_1)

# ---- group: transform box from frame to frame
crv_3 = Curve(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)
crv_4 = Curve(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)
crv_5 = Curve(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)
crv_6 = Curve(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)
pt_2 = Point(Point(-11.25160869, 22.08724197, 25.91983455))
vec_3 = Vector(crv_3)
vec_4 = Vector(crv_4)
pt_3 = Point(Point(57.6759268, -31.86215913, 32.87035713))
vec_5 = Vector(crv_5)
vec_6 = Vector(crv_6)
transform_box_2 = Python3Script(point1=pt_2, xaxis1=vec_3, yaxis1=vec_4, point2=pt_3, xaxis2=vec_5, yaxis2=vec_6)  # -> box_in_frame_1, box_in_frame_2; inputs point1: Point3d, point2: Point3d
# ---------- transform_box_2: Python ----------
"""Example: Bring a box from the world coordinate system into another coordinate system.
"""
from compas.geometry import Frame
from compas.geometry import Transformation
from compas.geometry import Box
from compas.datastructures import Mesh
from compas_rhino.conversions import frame_to_rhino, point_to_compas, vector_to_compas, mesh_to_rhino


# Box in Frame 1
point1 = point_to_compas(point1)
xaxis1 = vector_to_compas(xaxis1)
yaxis1 = vector_to_compas(yaxis1)

F1 = Frame(point1, xaxis1, yaxis1)
width, length, height = 10, 10, 10
box = Box(width, length, height, F1)

# Draw mesh
mesh = box.to_mesh()
box_in_frame_1 = mesh_to_rhino(mesh)

# Frame 2
point2 = point_to_compas(point2)
xaxis2 = vector_to_compas(xaxis2)
yaxis2 = vector_to_compas(yaxis2)

F2 = Frame(point2, xaxis2, yaxis2)

# Represent box frame in frame F2 and costruct new box
box_frame_transformed = F2.to_world_coordinates(box.frame)
box_transformed = Box(width, length, height, box_frame_transformed)
print("Box frame transformed", box_transformed.frame)

WTF2 = Transformation.from_change_of_basis(F2, Frame.worldXY())
mesh2 = mesh.transformed(WTF2)
box_in_frame_2 = mesh_to_rhino(mesh2)
# ---------- end transform_box_2 ----------
mesh_3 = Mesh(transform_box_2.box_in_frame_2)
mesh_4 = Mesh(transform_box_2.box_in_frame_1)

# ---- group: frame in frame
crv_7 = Curve(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)
crv_8 = Curve(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)
crv_9 = Curve(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)
crv_10 = Curve(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)
pt_4 = Point(Point(-11.25160869, 22.08724197, 25.91983455))
vec_7 = Vector(crv_7)
vec_8 = Vector(crv_8)
pt_5 = Point(Point(57.6759268, -31.86215913, 32.87035713))
vec_9 = Vector(crv_9)
vec_10 = Vector(crv_10)
frame_in_frame = Python3Script(point1=pt_4, xaxis1=vec_7, yaxis1=vec_8, point2=pt_5, xaxis2=vec_9, yaxis2=vec_10)  # -> F1, F2_local, F2_world; inputs point1: Point3d, point2: Point3d
# ---------- frame_in_frame: Python ----------
"""Example: 'frame in frame'
"""
from compas.geometry import Point
from compas.geometry import Vector
from compas.geometry import Frame

from compas_rhino.conversions import frame_to_rhino, point_to_compas, vector_to_compas

# Frame 1
point = point_to_compas(point1)
xaxis = vector_to_compas(xaxis1)
yaxis = vector_to_compas(yaxis1)
F1 = Frame(point, xaxis, yaxis)

# Frame 2, local
point = point_to_compas(point2)
xaxis = vector_to_compas(xaxis2)
yaxis = vector_to_compas(yaxis2)
F2 = Frame(point, xaxis, yaxis)

# Frame 2 in Frame 1, represented in global (world) coordinate system
F2_world = F1.to_world_coordinates(F2)
print(F2_world)

# check
F2_local = F1.to_local_coordinates(F2_world)
print(F2_local)

print(F2 == F2_local)

F1 = frame_to_rhino(F1)
F2_local = frame_to_rhino(F2_local)
F2_world = frame_to_rhino(F2_world)
# ---------- end frame_in_frame ----------
pln = Plane(frame_in_frame.F2_local)
pln_2 = Plane(frame_in_frame.F2_world)

# ---- group: frame construction
list = ValueList({"from compas point and vectors": 0, "from list point and vectors": 1, "from points": 2, "from compas plane": 3, "from euler angles": 4, "world frame": 5, "from rhino plane": 6}, selected="from compas point and vectors")
pln_3 = Plane(Plane(origin=(-11.25160869, 22.08724197, 25.91983455), x=(0.7495005578, -0.5910962845, 0.2980840425), y=(0.5492517264, 0.8066010058, 0.2184430328)))
construct_frame = Python3Script(option=list, plane=pln_3)  # -> out, plane_F
# ---------- construct_frame: Python ----------
"""There are several ways to construst a `Frame`.
"""
from compas.geometry import Point
from compas.geometry import Vector
from compas.geometry import Frame
from compas.geometry import Plane

from compas_rhino.conversions import frame_to_rhino, plane_to_compas

if option == 0:
    F = Frame(Point(1, 0, 0), Vector(-0.45, 0.1, 0.3), Vector(1, 0, 0))
    print("Frame from compas point and vectors: ")
elif option == 1:
    F = Frame([1, 0, 0], [-0.45, 0.1, 0.3], [1, 0, 0])
    print("Frame from point, x-axis and y-axis as list: ")
elif option == 2:
    F = Frame.from_points([1, 1, 1], [2, 3, 6], [6, 3, 0])
    print("Frame from three points as list: ")
elif option == 3:
    F = Frame.from_plane(Plane([0, 0, 0], [0.5, 0.2, 0.1]))
    print("Frame from compas plane: ")
elif option == 4:
    F = Frame.from_euler_angles([0.5, 1., 0.2])
    print("Frame from euler angles: ")
elif option == 5:
    F = Frame.worldXY()
    print("World XY frame")
elif option == 6:
    F = plane_to_compas(plane)
    print("Frame from Rhino plane:")

print(F)

plane_F = frame_to_rhino(F)
# ---------- end construct_frame ----------
pln_4 = Plane(construct_frame.plane_F)
panel = Panel(construct_frame.out)

# ---- group: frames as coordinate systems
crv_11 = Curve(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)
crv_12 = Curve(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)
pt_6 = Point(Point(-11.25160869, 22.08724197, 25.91983455))
vec_11 = Vector(crv_12)
vec_12 = Vector(crv_11)
coordinate = Python3Script(point=pt_6, xaxis=vec_11, yaxis=vec_12)  # -> pt_world, pt_local; inputs point: Point3d
# ---------- coordinate: Python ----------
"""Example: 'point in frame'
"""
from compas.geometry import Point
from compas.geometry import Vector
from compas.geometry import Frame
from compas_rhino.conversions import point_to_rhino, point_to_compas, vector_to_compas

# convert to compas
point = point_to_compas(point)
xaxis = vector_to_compas(xaxis)
yaxis = vector_to_compas(yaxis)

# coordinate system F
F = Frame(point, xaxis, yaxis)

# point in F (local coordinates)
P_local = Point(15., 15., 15.) # point in frame

# point in global (world) coordinates
P_world = F.to_world_coordinates(P_local)
print(P_world)

# check
P_local_check = F.to_local_coordinates(P_world)
print(P_local_check)

pt_world = point_to_rhino(P_world)
pt_local = point_to_rhino(P_local_check)
# ---------- end coordinate ----------
pt_7 = Point(coordinate.pt_world)
pt_8 = Point(coordinate.pt_local)

# ----
# Frames
pln_5 = Plane(frame_in_frame.F1)

# ---- group: transformation between two frames
crv_13 = Curve(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)
crv_14 = Curve(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)
crv_15 = Curve(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)
crv_16 = Curve(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)
vec_13 = Vector(crv_15)
vec_14 = Vector(crv_16)
pt_9 = Point(Point(57.6759268, -31.86215913, 32.87035713))
vec_15 = Vector(crv_13)
vec_16 = Vector(crv_14)
pt_10 = Point(Point(-11.25160869, 22.08724197, 25.91983455))
transform_from_f_to_f = Python3Script(point1=pt_10, xaxis1=vec_13, yaxis1=vec_14, point2=pt_9, xaxis2=vec_15, yaxis2=vec_16)  # -> out, F1, F2, curve; inputs point1: Point3d, point2: Point3d
# ---------- transform_from_f_to_f: Python ----------
"""Example: 'frame in frame'
"""
from compas.geometry import Point, Vector, Frame, Transformation, Bezier, Curve
from compas_rhino.conversions import frame_to_rhino, polyline_to_rhino, point_to_compas, vector_to_compas

# Frame 1
point = point_to_compas(point1)
xaxis = vector_to_compas(xaxis1)
yaxis = vector_to_compas(yaxis1)
F1 = Frame(point, xaxis, yaxis)

# Frame 2, local
point = point_to_compas(point2)
xaxis = vector_to_compas(xaxis2)
yaxis = vector_to_compas(yaxis2)
F2 = Frame(point, xaxis, yaxis)

T = Transformation.from_frame_to_frame(F1, F2)

print("Transformation between F1 and F2: ")
print(T)

# Just for visualization
pts = [F1.point, F1.point+F1.zaxis*50, F2.point+F2.zaxis*50, F2.point]
curve = polyline_to_rhino(Bezier(pts).to_polyline(50))

F1 = frame_to_rhino(F1)
F2 = frame_to_rhino(F2)
# ---------- end transform_from_f_to_f ----------
panel_2 = Panel(transform_from_f_to_f.out)

# ---- group: transform box using T
crv_17 = Curve(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)
crv_18 = Curve(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)
crv_19 = Curve(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)
crv_20 = Curve(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)
pt_11 = Point(Point(57.6759268, -31.86215913, 32.87035713))
pt_12 = Point(Point(-11.25160869, 22.08724197, 25.91983455))
vec_17 = Vector(crv_18)
vec_18 = Vector(crv_19)
vec_19 = Vector(crv_17)
vec_20 = Vector(crv_20)
transform_using_t = Python3Script(point1=pt_12, xaxis1=vec_17, yaxis1=vec_18, point2=pt_11, xaxis2=vec_19, yaxis2=vec_20)  # -> out, box_in_frame_1, bbox_in_frame_2; inputs point1: Point3d, point2: Point3d
# ---------- transform_using_t: Python ----------
"""Example: Bring a box from the world coordinate system into another coordinate system.
"""
from compas.geometry import Point, Vector, Frame, Transformation, Box
from compas_rhino.conversions import frame_to_rhino, point_to_compas, vector_to_compas, mesh_to_rhino

# Frame 1
point = point_to_compas(point1)
xaxis = vector_to_compas(xaxis1)
yaxis = vector_to_compas(yaxis1)
F1 = Frame(point, xaxis, yaxis)

width, length, height = 10, 10, 10
box = Box(width, length, height, F1)

# Draw mesh
mesh = box.to_mesh()
box_in_frame_1 = mesh_to_rhino(mesh)

# Frame 2, local
point = point_to_compas(point2)
xaxis = vector_to_compas(xaxis2)
yaxis = vector_to_compas(yaxis2)
F2 = Frame(point, xaxis, yaxis)

# Get transformation between frames and apply transformation on box.
T = Transformation.from_frame(F2)
print(T)
box_in_frame_2 = box.transformed(T)

print("Box frame transformed", box_in_frame_2.frame)

mesh2 = box_in_frame_2.to_mesh()
box_in_frame_2 = mesh_to_rhino(mesh2)
# ---------- end transform_using_t ----------
panel_3 = Panel(transform_using_t.out)
mesh_5 = Mesh(transform_using_t.bbox_in_frame_2)
mesh_6 = Mesh(transform_using_t.box_in_frame_1)

# ----
# Transformations
crv_21 = Curve(transform_from_f_to_f.curve)
pln_6 = Plane(transform_from_f_to_f.F1)
pln_7 = Plane(transform_from_f_to_f.F2)

# ---- group: frames representation
# Frame presentation
crv_22 = Curve(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)
crv_23 = Curve(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)
pt_13 = Point(Point(-11.25160869, 22.08724197, 25.91983455))
vec_21 = Vector(crv_22)
vec_22 = Vector(crv_23)
representations = Python3Script(point=pt_13, xaxis=vec_21, yaxis=vec_22)  # -> out, point; inputs point: Point3d
# ---------- representations: Python ----------
"""Example: 'point in frame'
"""
from compas.geometry import Point
from compas.geometry import Vector
from compas.geometry import Frame
from compas_rhino.conversions import point_to_rhino, point_to_compas, vector_to_compas

# convert to compas
point = point_to_compas(point)
xaxis = vector_to_compas(xaxis)
yaxis = vector_to_compas(yaxis)

# coordinate system F
F = Frame(point, xaxis, yaxis)

point = point_to_rhino(F.point)

axis_angle_vector = F.axis_angle_vector
print("UR robots: axis angle vector: ")
print(axis_angle_vector)

euler_angles = F.euler_angles(static=True, axes='xyz') 
print("KUKA robots: euler_angles: ")
print(euler_angles)

quaternion = F.quaternion
print("ABB robots: quaternion")
print(quaternion)
# ---------- end representations ----------
pt_14 = Point(representations.point)
panel_4 = Panel(representations.out)

# ---- group: quaternions
q4 = Slider(-0.545, range=-1..1)
quaternions = Python3Script(q1=Slider(-0.347, range=-1..1), q2=Slider(0.22, range=-1..1), q3=Slider(-0.023, range=-1..1), q4=q4)  # -> out, plane, box_transf
# ---------- quaternions: Python ----------
"""Example: Rotations from quaternion representation.
"""

import math
from compas.geometry import Frame
from compas.geometry import Rotation
from compas.geometry import Box
from compas.datastructures import Mesh
from compas_rhino.conversions import frame_to_rhino_plane, mesh_to_rhino


# Quaternion input for the Rotation matrix
quaternion_a = [q1, q2, q3, q4]
R = Rotation.from_quaternion(quaternion_a)

# The basis vectors from the Rotation matrix
xaxis, yaxis = R.basis_vectors
print(xaxis)
print(yaxis)

# A frame created with the basis vectors of 
f1 = Frame([0,0,0], xaxis, yaxis)
R = Rotation.from_frame(f1)

quaternion_b = R.quaternion
print(quaternion_b)

print("quaternion_a ==", [round(val, 3) for val in quaternion_b])

# Transform box
box = Box.from_width_height_depth(10, 10, 10)
box.transform(R)

F = box.frame
plane = frame_to_rhino_plane(F)
box_transf = mesh_to_rhino(box.to_mesh())
# ---------- end quaternions ----------
mesh_7 = Mesh(quaternions.box_transf)

# ---- group: euler angles
gamma = Slider(3.14, range=-3.14..3.14)
euler_angles = Python3Script(xangle=Slider(2.02, range=-3.14..3.14), yangle=Slider(-2.88, range=-3.14..3.14), zangle=gamma)  # -> out, plane, box_transf
# ---------- euler_angles: Python ----------
"""Example: Rotations from euler angles, rotate an object based on 3 euler angles.
"""

import compas
from compas.geometry import Frame
from compas.geometry import Rotation
from compas.datastructures import Mesh
from compas.geometry import Box

from compas_rhino.conversions import frame_to_rhino_plane, mesh_to_rhino


# euler angles
static, axes = True, 'xyz'

# Version 1: Create Rotation from angles
R1 = Rotation.from_euler_angles([xangle, yangle, zangle], static, axes)

# Version 2: Concatenate 3 Rotations
xaxis, yaxis, zaxis = [1, 0, 0], [0, 1, 0], [0, 0, 1]
Rx = Rotation.from_axis_and_angle(xaxis, xangle)
Ry = Rotation.from_axis_and_angle(yaxis, yangle)
Rz = Rotation.from_axis_and_angle(zaxis, zangle)
 
if static: # check order!
    R2 = Rz * Ry * Rx
else:
    R2 = Rx * Ry * Rz

# Check
print(R1 == R2)

# Transform box
box = Box.from_width_height_depth(10, 10, 10)
box.transform(R1)

F = box.frame
plane = frame_to_rhino_plane(F)

mesh = box.to_mesh()
box_transf = mesh_to_rhino(mesh)
# ---------- end euler_angles ----------
mesh_8 = Mesh(euler_angles.box_transf)

# ---- group: axis angle
theta = Slider(-1.23, range=-3.14..3.14)
crv_24 = Curve(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)
vec_23 = Vector(crv_24)
pt_15 = Point(Point(-11.25160869, 22.08724197, 25.91983455))
axis_angle = Python3Script(point=pt_15, axis=vec_23, angle=theta)  # -> out, plane, box_transf
# ---------- axis_angle: Python ----------
"""Example: Rotations from axis angle representation, rotate an object based on 3 euler angles.
"""

import math
from compas.geometry import Frame
from compas.geometry import Rotation
from compas.geometry import Box
from compas.datastructures import Mesh
from compas_rhino.conversions import frame_to_rhino_plane, mesh_to_rhino, vector_to_compas

axis = vector_to_compas(axis)

R = Rotation.from_axis_and_angle(axis, angle)
print(R)

box = Box.from_width_height_depth(10, 10, 10)

box.transform(R)
F = box.frame
plane = frame_to_rhino_plane(F)

mesh = box.to_mesh()
box_transf = mesh_to_rhino(mesh)
# ---------- end axis_angle ----------
mesh_9 = Mesh(axis_angle.box_transf)
panel_5 = Panel(axis_angle.out)
