# Grasshopper definition ex1-meshes.ghx (Grasshopper 1.0.8)
# plug-ins: RhinoCodePluginGH

# ---- group: Mesh from file
data = Python3Script()  # -> PATH
# ---------- data: Python ----------
import os
import ghpythonlib.components as ghcomp

ghComp = ghenv.Component
ghDoc = ghComp.OnPingDocument()

# the full path of the gh file
path_gh_file = ghDoc.FilePath

# the directory of the gh file
HERE = os.path.dirname(path_gh_file)
DATA = os.path.join(HERE, 'data')
PATH = os.path.join(DATA, 'faces.obj')

print(PATH)
# ---------- end data ----------
from_file = Python3Script(PATH=data)  # -> mesh
# ---------- from_file: Python ----------
import compas
from compas.datastructures import Mesh

# import the mesh
mesh = Mesh.from_obj(PATH)
# ---------- end from_file ----------

# ---- group: Mesh from meshgrid
from_meshgrid = Python3Script()  # -> mesh
# ---------- from_meshgrid: Python ----------
from compas.datastructures import Mesh

mesh = Mesh.from_meshgrid(dx=10, dy=10, nx=10, ny=10)
# ---------- end from_meshgrid ----------

# ---- group: Mesh from scratch
from_scratch = Python3Script()  # -> mesh
# ---------- from_scratch: Python ----------
from compas.datastructures import Mesh

mesh = Mesh()
a = mesh.add_vertex(x=0, y=0, z=0)
b = mesh.add_vertex(x=1, y=0, z=0)
c = mesh.add_vertex(x=1, y=1, z=0)
d = mesh.add_vertex(x=0, y=1, z=0)
face = mesh.add_face([a, b, c, d])
# ---------- end from_scratch ----------

# ---- group: Mesh from geometry
from_geometry = Python3Script()  # -> mesh
# ---------- from_geometry: Python ----------
from compas.datastructures import Mesh
from compas.geometry import Circle

circle = Circle(radius=5)
mesh = Mesh.from_polygons([circle.to_polygon(n=16)])
# ---------- end from_geometry ----------

# ----
list = ValueList({"mesh from file": 0, "mesh from meshgrid": 1, "mesh from scratch": 2, "mesh from geometry": 3}, selected="mesh from meshgrid")
p_n_c = PickNChoose(Pattern=list, Stream0=from_file, Stream1=from_meshgrid, Stream2=from_scratch, Stream3=from_geometry)
visualize = Python3Script(mesh=p_n_c, index=Slider(26, range=0..35))  # -> out, mesh, vertices, edges, faces, labels, current_vertex, current_vertex_neighbors, colors_bfo, vertices_bfo; inputs index: Int32
# ---------- visualize: Python ----------
from compas.datastructures import Mesh
from compas_rhino.conversions import mesh_to_rhino, point_to_rhino, line_to_rhino, sphere_to_rhino, mesh_to_rhino
from compas.topology import breadth_first_ordering
from compas.colors import Color
from compas.geometry import Sphere
import rhinoscriptsyntax as rs

# Draw points on vertices
vertices = [point_to_rhino(mesh.vertex_point(vertex)) for vertex in mesh.vertices()]
labels = [key for key in mesh.vertices()]
# Draw lines on edges
edges = [line_to_rhino(mesh.edge_line(edge)) for edge in mesh.edges()]
# Draw polygons on faces
faces = [mesh_to_rhino(mesh.face_polygon(face).to_mesh()) for face in mesh.faces()]

# breadth_first_ordering
keys_bfo = breadth_first_ordering(mesh.adjacency, index)
print(keys_bfo)
# color range
n = mesh.number_of_vertices()
colors_bfo = [rs.CreateColor(Color.from_i(1 - index / n).rgb255) for index, key in enumerate(keys_bfo)]
vertices_bfo = [point_to_rhino(mesh.vertex_point(vertex)) for vertex in keys_bfo]

# draw current and neighbor vertices
current_vertex = {'pos': mesh.vertex_coordinates(index), 'radius': 0.5}
current_vertex = sphere_to_rhino(Sphere(radius=current_vertex['radius'], point=current_vertex['pos']))

current_vertex_neighbors_keys = mesh.vertex_neighbors(index)
print(current_vertex_neighbors_keys)

current_vertex_neighbors = [{'pos': mesh.vertex_coordinates(key), 'radius': 0.4} for key in current_vertex_neighbors_keys]
current_vertex_neighbors = [sphere_to_rhino(Sphere(radius=neighbor['radius'], point=neighbor['pos'])) for neighbor in current_vertex_neighbors]

# Mesh to rhino
mesh = mesh_to_rhino(mesh)
# ---------- end visualize ----------
pt = Point(visualize.vertices)
brep = Brep(visualize.current_vertex)
brep_2 = Brep(visualize.current_vertex_neighbors)
line = Line(visualize.edges)
tag = TextTag3D(Location=pt, Text=visualize.labels, Size=0.3, Colour=ColourSwatch(SwatchColor=RGB(0, 0, 0)), Justification=7)
preview = CustomPreview(Geometry=brep, Material=ColourSwatch(SwatchColor=RGB(255, 48, 48)))
preview_2 = CustomPreview(Geometry=brep_2, Material=ColourSwatch(SwatchColor=RGB(255, 207, 207)))

shader = Shader(visualize.colors_bfo)
pt_2 = Point(visualize.vertices_bfo)
mesh = Mesh(visualize.faces)

preview_3 = CustomPreview(Geometry=pt_2, Material=shader)
