# Grasshopper definition ex2-graphs.ghx (Grasshopper 1.0.8)
# plug-ins: RhinoCodePluginGH

# ---- group: Graph from file
data = Python3Script()  # -> PATH
# ---------- data: Python ----------
import os
import ghpythonlib.components as ghcomp

ghComp = ghenv.Component
ghDoc = ghComp.OnPingDocument()

# the full path of the gh file
path_gh_file = ghDoc.FilePath

# the directory of the gh file
HERE = os.path.dirname(path_gh_file)
DATA = os.path.join(HERE, 'data')
PATH = os.path.join(DATA, 'lines.obj')

print(PATH)
# ---------- end data ----------
create_graph = Python3Script(PATH=data)  # -> graph
# ---------- create_graph: Python ----------
from compas.datastructures import Graph

# import the mesh
graph = Graph.from_obj(PATH)
# ---------- end create_graph ----------

# ---- group: Graph from lines
line = Line([Line((16.23840007, 5.480409529, 0), (19.53971621, 1.85027704, 0)), Line((19.53971621, 1.85027704, 0), (21.88088862, 5.440951567, 0)), Line((16.23840007, 5.480409529, 0), (21.88088862, 5.440951567, 0)), Line((16.23840007, 5.480409529, 0), (18.22445082, 8.926404863, 0)), Line((18.22445082, 8.926404863, 0), (21.88088862, 5.440951567, 0)), Line((18.22445082, 8.926404863, 0), (22.11763639, 9.439358367, 0))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])
create_graph_2 = Python3Script(lines=line)  # -> graph; inputs lines: list of Line
# ---------- create_graph_2: Python ----------
from compas.datastructures import Graph
from compas_rhino.conversions import line_to_compas

#create graph from lines
compas_lines = [line_to_compas(line) for line in lines]
graph = Graph.from_lines(compas_lines)
# ---------- end create_graph_2 ----------

# ----
list = ValueList({"graph from file": 0, "graph from lines": 1}, selected="graph from file")
p_n_c = PickNChoose(Pattern=list, Stream0=create_graph, Stream1=create_graph_2)
visualize = Python3Script(graph=p_n_c, key=Slider(1, range=0..6))  # -> out, nodes, edges, current_node, current_node_neighbors, labels
# ---------- visualize: Python ----------
from compas.geometry import Sphere
from compas.datastructures import Mesh
from compas_rhino.conversions import sphere_to_rhino, point_to_rhino, line_to_rhino

# draw graph in Rhino
nodes = [point_to_rhino(point) for point in graph.to_points()]
edges = [line_to_rhino(line) for line in graph.to_lines()]
labels = [key for key in graph.nodes()]

current_node = {'pos': graph.node_coordinates(key), 'radius': 0.5}
current_node = sphere_to_rhino(Sphere(radius=current_node['radius'], point=current_node['pos']))

current_node_neighbors_keys = graph.neighbors(key)
print(current_node_neighbors_keys)

current_node_neighbors = [{'pos': graph.node_coordinates(key), 'radius': 0.4} for key in current_node_neighbors_keys]
current_node_neighbors = [sphere_to_rhino(Sphere(radius=neighbor['radius'], point=neighbor['pos'])) for neighbor in current_node_neighbors]
# ---------- end visualize ----------
pt = Point(visualize.nodes)
line_2 = Line(visualize.edges)
brep = Brep(visualize.current_node)
brep_2 = Brep(visualize.current_node_neighbors)
preview = CustomPreview(Geometry=brep, Material=ColourSwatch(SwatchColor=RGB(255, 48, 48)))
preview_2 = CustomPreview(Geometry=pt, Material=ColourSwatch(SwatchColor=RGB(255, 0, 0)))
preview_3 = CustomPreview(Geometry=brep_2, Material=ColourSwatch(SwatchColor=RGB(255, 207, 207)))
tag = TextTag3D(Location=pt, Text=visualize.labels, Size=0.3, Colour=ColourSwatch(SwatchColor=RGB(0, 0, 0)), Justification=7)
preview_4 = CustomPreview(Geometry=line_2, Material=ColourSwatch(SwatchColor=RGB(255, 48, 48)))
