# Grasshopper definition ex1-mesh-image-sampler.ghx (Grasshopper 1.0.8)
# plug-ins: RhinoCodePluginGH

# ---- group: Mesh from geometry
# Create mesh
number_slider = Slider(20, range=0..20)
create_geometry = Python3Script(rad=number_slider)  # -> sphere
# ---------- create_geometry: Python ----------
from compas.geometry import Sphere

sphere = Sphere(radius=rad*10)
# ---------- end create_geometry ----------
from_geometry = Python3Script(sphere=create_geometry)  # -> mesh
# ---------- from_geometry: Python ----------
from compas.datastructures import Mesh

mesh = sphere_mesh = Mesh.from_shape(sphere)
# ---------- end from_geometry ----------

# ---- group: Mesh from file
data = Python3Script()  # -> PATH
# ---------- data: Python ----------
import os
import ghpythonlib.components as ghcomp

ghComp = ghenv.Component
ghDoc = ghComp.OnPingDocument()

# the full path of the gh file
path_gh_file = ghDoc.FilePath

# the directory of the gh file
HERE = os.path.dirname(path_gh_file)
DATA = os.path.join(HERE, 'data')
PATH = os.path.join(DATA, 'faces2.obj')

print(PATH)
# ---------- end data ----------
from_file = Python3Script(PATH=data)  # -> mesh; inputs PATH: String
# ---------- from_file: Python ----------
import compas
from compas.datastructures import Mesh

# import the mesh
mesh = Mesh.from_obj(PATH)
# ---------- end from_file ----------

# ---- group: Mesh from meshgrid
from_meshgrid = Python3Script(create=Button())  # -> mesh, vertices
# ---------- from_meshgrid: Python ----------
from compas.datastructures import Mesh
from compas_rhino.conversions import point_to_rhino

mesh = Mesh.from_meshgrid(dx=500, dy=500, nx=10, ny=10)

# Draw points on vertices
vertices = [point_to_rhino(mesh.vertex_point(vertex)) for vertex in mesh.vertices()]
# ---------- end from_meshgrid ----------

# ---- group: image sample
# Transform
image = ImageSampler(from_meshgrid.vertices, Filter="Value", Interpolate=True, Umax=1, Umin=0, Vmax=1, Vmin=0, Wrap=1)
gradient = Gradient(LowerLimit=0, UpperLimit=1, Parameter=image, stops=[0: RGB(255, 254, 254), 1: RGB(0, 0, 0)])
transform = Python3Script(mesh=from_meshgrid.mesh, values=image)  # -> new_mesh; inputs values: list of Double
# ---------- transform: Python ----------
from compas.geometry import Translation, Vector

new_mesh = mesh.copy()

for i, vertex in enumerate(new_mesh.vertices()):
    value = (1-values[i])*100
    T = Translation.from_vector([0,0,value])

    vertex_point = new_mesh.vertex_point(vertex)
    new_vertex_point = vertex_point.transformed(T)
    new_mesh.set_vertex_point(vertex, new_vertex_point)
# ---------- end transform ----------

# ---- group: attraction point
pt = Point(Point(310.8309591, 353.54584, 133.2736402))
transform_2 = Python3Script(mesh=from_meshgrid.mesh, a_point=pt)  # -> new_mesh; inputs a_point: Point3d
# ---------- transform_2: Python ----------
from compas.geometry import Translation, Vector, distance_point_point
from compas_rhino.conversions import point_to_compas

new_mesh = mesh.copy()
a_point = point_to_compas(a_point)

for i, vertex in enumerate(new_mesh.vertices()):
    vertex_point = new_mesh.vertex_point(vertex)

    value = distance_point_point(a_point, vertex_point)/2
    
    T = Translation.from_vector([0,0,-value])

    new_vertex_point = vertex_point.transformed(T)
    new_mesh.set_vertex_point(vertex, new_vertex_point)
# ---------- end transform_2 ----------

# ---- group: attraction curve
crv = Curve(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)
transform_3 = Python3Script(mesh=from_meshgrid.mesh, a_curve=crv)  # -> new_mesh; inputs a_curve: Curve
# ---------- transform_3: Python ----------
from compas.geometry import Translation, Vector, distance_point_line
from compas_rhino.conversions import curve_to_compas_line

new_mesh = mesh.copy()
a_curve = curve_to_compas_line(a_curve)

for i, vertex in enumerate(new_mesh.vertices()):
    vertex_point = new_mesh.vertex_point(vertex)

    value = distance_point_line(vertex_point, a_curve)/2
    
    T = Translation.from_vector([0,0,-value])

    new_vertex_point = vertex_point.transformed(T)
    new_mesh.set_vertex_point(vertex, new_vertex_point)
# ---------- end transform_3 ----------

# ----
# Visualize
list = ValueList({"From shape": 0, "From file": 1, "Mesh grid": 2, "Image sample": 3, "Attraction point": 4, "Attraction curve": 5}, selected="Image sample")
material = Python3Script(P=list, M=ColourSwatch(SwatchColor=RGB(0, 0, 0)), G=gradient)  # -> R
# ---------- material: Python ----------
if P == 3:
    R = G
else:
    R = M
# ---------- end material ----------
p_n_c = PickNChoose(
    Pattern=list,
    Stream0=from_geometry,
    Stream1=from_file,
    Stream2=from_meshgrid.mesh,
    Stream3=transform,
    Stream4=transform_2,
    Stream5=transform_3)
visualize = Python3Script(mesh=p_n_c)  # -> out, mesh, vertices, edges, faces, labels
# ---------- visualize: Python ----------
from compas.datastructures import Mesh
from compas_rhino.conversions import mesh_to_rhino, point_to_rhino, line_to_rhino, sphere_to_rhino, mesh_to_rhino

# Draw points on vertices
vertices = [point_to_rhino(mesh.vertex_point(vertex)) for vertex in mesh.vertices()]
labels = [key for key in mesh.vertices()]
# Draw lines on edges
edges = [line_to_rhino(mesh.edge_line(edge)) for edge in mesh.edges()]
# Draw polygons on faces
faces = [mesh_to_rhino(mesh.face_polygon(face).to_mesh()) for face in mesh.faces()]
# Mesh to rhino
mesh = mesh_to_rhino(mesh)
# ---------- end visualize ----------
pt_2 = Point(visualize.vertices)
line = Line(visualize.edges)
mesh = Mesh(visualize.faces)
preview = CustomPreview(Geometry=pt_2, Material=material)
tag = TextTag3D(Location=pt_2, Text=visualize.labels, Size=5, Colour=ColourSwatch(SwatchColor=RGB(0, 0, 0)), Justification=7)
