# Grasshopper definition ex2-graph-robot.ghx (Grasshopper 1.0.8)
# plug-ins: RhinoCodePluginGH

# ---- group: Graph from file
# Create graph
data = Python3Script()  # -> PATH
# ---------- data: Python ----------
import os
import ghpythonlib.components as ghcomp

ghComp = ghenv.Component
ghDoc = ghComp.OnPingDocument()

# the full path of the gh file
path_gh_file = ghDoc.FilePath

# the directory of the gh file
HERE = os.path.dirname(path_gh_file)
DATA = os.path.join(HERE, 'data')
PATH = os.path.join(DATA, 'lines.obj')

print(PATH)
# ---------- end data ----------
create_graph = Python3Script(PATH=data)  # -> graph; inputs PATH: String
# ---------- create_graph: Python ----------
from compas.datastructures import Graph

# import the mesh
graph = Graph.from_obj(PATH)
# ---------- end create_graph ----------

# ---- group: Robot graph
# Create robot graph
bang = Button()
create_robot = Python3Script(bang=bang)  # -> my_robot
# ---------- create_robot: Python ----------
from compas.geometry import Box, Sphere, Cone, Frame, Translation, Vector
from compas.datastructures import Mesh, Graph
from compas_rhino.conversions import point_to_rhino

my_robot = Graph()

# Add a shoulder node
shoulder_frame = Frame.worldXY()

my_robot.add_node(key=0, name="shoulder", frame=shoulder_frame, mesh=Mesh.from_shape(Sphere(0.5)), x=shoulder_frame.point.x, y=shoulder_frame.point.y, z=shoulder_frame.point.z)

# Translate the shoulder frame to elbow frame
elbow_frame = shoulder_frame.transformed(Translation.from_vector(Vector.Yaxis()*4))

# Add a elbow node
my_robot.add_node(key=1, name="elbow", frame=elbow_frame, mesh=Mesh.from_shape(Sphere(0.5)), x=elbow_frame.point.x, y=elbow_frame.point.y, z=elbow_frame.point.z)

# Add an adge between shoulder and elbow
my_robot.add_edge(0,1)

# Translate the elbow frame to wrist 1 frame
wrist1_frame = elbow_frame.transformed(Translation.from_vector(Vector.Yaxis()*3))

# Add a wrist 1 node
my_robot.add_node(key=2, name="wrist1", frame=wrist1_frame, mesh=Mesh.from_shape(Box(0.8)), x=wrist1_frame.point.x, y=wrist1_frame.point.y, z=wrist1_frame.point.z)

# Add an adge between elbow and wrist 1
my_robot.add_edge(1,2)

# Translate the elbow frame to wrist 2 frame
wrist2_frame = elbow_frame.transformed(Translation.from_vector(Vector.Xaxis()*2))

# Add a wrist 2 node
my_robot.add_node(key=3, name="wrist2", frame=wrist2_frame, mesh=Mesh.from_shape(Cone(radius=0.5, height=1.0)), x=wrist2_frame.point.x, y=wrist2_frame.point.y, z=wrist2_frame.point.z)

# Add an adge between elbow and wrist 2
my_robot.add_edge(1,3)
# ---------- end create_robot ----------

# ---- group: Graph from lines
line = Line([Line((16.23840007, 5.480409529, 0), (19.53971621, 1.85027704, 0)), Line((19.53971621, 1.85027704, 0), (21.88088862, 5.440951567, 0)), Line((16.23840007, 5.480409529, 0), (21.88088862, 5.440951567, 0)), Line((16.23840007, 5.480409529, 0), (18.22445082, 8.926404863, 0)), Line((18.22445082, 8.926404863, 0), (21.88088862, 5.440951567, 0)), Line((18.22445082, 8.926404863, 0), (22.11763639, 9.439358367, 0))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])
create_graph_2 = Python3Script(lines=line)  # -> graph; inputs lines: list of Line
# ---------- create_graph_2: Python ----------
from compas.datastructures import Graph
from compas_rhino.conversions import line_to_compas

#create graph from lines
compas_lines = [line_to_compas(line) for line in lines]
graph = Graph.from_lines(compas_lines)
# ---------- end create_graph_2 ----------

# ---- group: move the robot
list = ValueList({"shoulder", "elbow"}, selected="shoulder")
rotate = Python3Script(my_robot=create_robot, joint=list, rot=Slider(313, range=0..360))  # -> my_robot; inputs rot: Int32
# ---------- rotate: Python ----------
from compas.geometry import Point, Rotation, Vector
import math

my_robot = my_robot.copy()
for key in my_robot.nodes_where({"name": joint}):
    origin = my_robot.node_attribute(key, "frame").point

    R = Rotation.from_axis_and_angle(Vector.Zaxis(), math.radians(rot), origin)

    connected_neighbors = my_robot.neighbors_out(key)
    for n_key in connected_neighbors:
        connected_neighbors = connected_neighbors + my_robot.neighbors_out(n_key)

    for neighbor_key in connected_neighbors:
        my_robot.node_attribute(neighbor_key, "frame").transform(R)
        my_robot.node_attribute(neighbor_key, "x", my_robot.node_attribute(neighbor_key, "frame").point.x)
        my_robot.node_attribute(neighbor_key, "y", my_robot.node_attribute(neighbor_key, "frame").point.y)
# ---------- end rotate ----------

# ----
# Visualize
list_2 = ValueList({"graph from file": 0, "graph from lines": 1}, selected="graph from lines")
p_n_c = PickNChoose(Pattern=list_2, Stream0=create_graph, Stream1=create_graph_2)
visualize = Python3Script(graph=p_n_c, key=Slider(5, range=0..6))  # -> out, nodes, edges, current_node, current_node_neighbors, labels
# ---------- visualize: Python ----------
from compas.geometry import Sphere
from compas.datastructures import Mesh
from compas_rhino.conversions import sphere_to_rhino, point_to_rhino, line_to_rhino

# draw graph in Rhino
nodes = [point_to_rhino(point) for point in graph.to_points()]
edges = [line_to_rhino(line) for line in graph.to_lines()]
labels = [key for key in graph.nodes()]

current_node = {'pos': graph.node_coordinates(key), 'radius': 0.5}
current_node = sphere_to_rhino(Sphere(radius=current_node['radius'], point=current_node['pos']))

current_node_neighbors_keys = graph.neighbors(key)
print(current_node_neighbors_keys)

current_node_neighbors = [{'pos': graph.node_coordinates(key), 'radius': 0.4} for key in current_node_neighbors_keys]
current_node_neighbors = [sphere_to_rhino(Sphere(radius=neighbor['radius'], point=neighbor['pos'])) for neighbor in current_node_neighbors]
# ---------- end visualize ----------
pt = Point(visualize.nodes)
line_2 = Line(visualize.edges)
brep = Brep(visualize.current_node)
brep_2 = Brep(visualize.current_node_neighbors)
preview = CustomPreview(Geometry=brep, Material=ColourSwatch(SwatchColor=RGB(255, 48, 48)))
preview_2 = CustomPreview(Geometry=pt, Material=ColourSwatch(SwatchColor=RGB(255, 0, 0)))
preview_3 = CustomPreview(Geometry=brep_2, Material=ColourSwatch(SwatchColor=RGB(255, 207, 207)))
tag = TextTag3D(Location=pt, Text=visualize.labels, Size=0.3, Colour=ColourSwatch(SwatchColor=RGB(0, 0, 0)), Justification=7)
preview_4 = CustomPreview(Geometry=line_2, Material=ColourSwatch(SwatchColor=RGB(255, 48, 48)))

# ---- group: visualize
visualize_2 = Python3Script(my_robot=rotate, show=Toggle(True))  # -> frames, nodes, edges, joints, links, labels
# ---------- visualize_2: Python ----------
from compas_rhino.conversions import point_to_rhino, line_to_rhino, mesh_to_rhino, frame_to_rhino_plane, cylinder_to_rhino
from compas.geometry import Transformation, Cylinder, Line

if show:
    keys = [key for key in my_robot.nodes()]

    nodes = [point_to_rhino(point) for point in my_robot.to_points()]

    edges = [line_to_rhino(line) for line in my_robot.to_lines()]

    frames = [frame_to_rhino_plane(my_robot.node_attribute(key, "frame")) for key in my_robot.nodes()]

    joints = [mesh_to_rhino(my_robot.node_attribute(key, "mesh").transformed(Transformation.from_frame(my_robot.node_attribute(key, "frame")))) for key in my_robot.nodes()]

    links = [cylinder_to_rhino(Cylinder.from_line_and_radius(Line(line[0], line[1]), 0.2)) for line in my_robot.to_lines()]

    labels = [my_robot.node_attribute(key, "name") for key in my_robot.nodes()]
# ---------- end visualize_2 ----------
pt_2 = Point(visualize_2.nodes)
line_3 = Line(visualize_2.edges)
mesh = Mesh(visualize_2.joints)
preview_5 = CustomPreview(Geometry=mesh, Material=ColourSwatch(SwatchColor=RGBA(255, 207, 207, 131)))
tag_2 = TextTag3D(Location=pt_2, Text=visualize_2.labels, Size=0.3, Colour=ColourSwatch(SwatchColor=RGB(0, 0, 0)), Justification=7)
deplane = DeconstructPlane(Plane=visualize_2.frames)  # -> Origin, XAxis, YAxis, ZAxis
vdisex = VectorDisplayEx(Point=deplane.Origin, Vector=deplane.XAxis, Colour=ColourSwatch(SwatchColor=RGB(255, 0, 0)), Width=2)
vdisex_2 = VectorDisplayEx(Point=deplane.Origin, Vector=deplane.YAxis, Colour=ColourSwatch(SwatchColor=RGB(149, 255, 0)), Width=2)
vdisex_3 = VectorDisplayEx(Point=deplane.Origin, Vector=deplane.ZAxis, Colour=ColourSwatch(SwatchColor=RGB(0, 140, 255)), Width=2)
